# Grasshopper definition linear_actuator_client.ghx (Grasshopper 1.0.8)
# plug-ins: eleFront

srf = Surface(<surface referenced from the Rhino model>)
block_definition = ModelBlockDefinition(<model block definition referenced from the Rhino model>)
number_slider = Slider(5, range=0..10)
number_slider_2 = Slider(4, range=0..10)
number_slider_3 = Slider(450, range=0..1000)
number_slider_4 = Slider(4, range=0..10)
block_definition_2 = ModelBlockDefinition(<model block definition referenced from the Rhino model>)
pt = Point(<point referenced from the Rhino model>)
pt_2 = Point(Point(192.0000015, 144.1598235, 60.66119645))
gridgenerator = GridGenerator(object=block_definition, relay=pt_2, N=number_slider, N_2=number_slider_2, F=number_slider_3, A=number_slider_4)
gridgenerator_2 = GridGenerator(object=block_definition_2, relay=pt, N=number_slider, N_2=number_slider_2, F=number_slider_3, A=number_slider_4)
prjtargetextend = CSharpScript(x=srf)  # -> out, a; inputs x: Surface
# ---------- prjtargetextend: C# ----------
// Grasshopper Script Instance
#region Usings
using System;
using System.Linq;
using System.Collections;
using System.Collections.Generic;
using System.Drawing;

using Rhino;
using Rhino.Geometry;

using Grasshopper;
using Grasshopper.Kernel;
using Grasshopper.Kernel.Data;
using Grasshopper.Kernel.Types;
#endregion

public class Script_Instance : GH_ScriptInstance
{
    #region Notes
    /* 
      Members:
        RhinoDoc RhinoDocument
        GH_Document GrasshopperDocument
        IGH_Component Component
        int Iteration

      Methods (Virtual & overridable):
        Print(string text)
        Print(string format, params object[] args)
        Reflect(object obj)
        Reflect(object obj, string method_name)
    */
    #endregion

    private void RunScript(Surface x, ref object a)
    {
        // Write your logic here
        var srv01 = x.Extend(IsoStatus.East,100,true).Extend(IsoStatus.West,100,true);
        var srv02 = srv01.Extend(IsoStatus.North,100,true).Extend(IsoStatus.South,100,true);
        a = srv02;
    }
}
# ---------- end prjtargetextend ----------
Z = UnitZ(Factor=1)
pt_3 = Point(gridgenerator_2)
clean = CleanTree(RemoveNulls=True, RemoveInvalid=True, RemoveEmpty=False, Tree=pt_3)
flatten = FlattenTree(Tree=clean, Path="{0}")
project = ProjectPoint(Point=clean, Direction=Z, Geometry=prjtargetextend.a)  # -> Point, Index

c_script = CSharpScript(x=gridgenerator)  # -> out, a; inputs x: tree
# ---------- c_script: C# ----------
// Grasshopper Script Instance
#region Usings
using System;
using System.Linq;
using System.Collections;
using System.Collections.Generic;
using System.Drawing;

using Rhino;
using Rhino.Geometry;

using Grasshopper;
using Grasshopper.Kernel;
using Grasshopper.Kernel.Data;
using Grasshopper.Kernel.Types;
#endregion

public class Script_Instance : GH_ScriptInstance
{
    #region Notes
    /* 
      Members:
        RhinoDoc RhinoDocument
        GH_Document GrasshopperDocument
        IGH_Component Component
        int Iteration

      Methods (Virtual & overridable):
        Print(string text)
        Print(string format, params object[] args)
        Reflect(object obj)
        Reflect(object obj, string method_name)
    */
    #endregion

    private void RunScript(DataTree<object> x, object y, ref object a)
    {
        // Write your logic here
        DataTree<string> paths= new();
        foreach (var path in x.Paths){
            string itemPath = string.Join(":", path.Indices);
            int i = 0;
            foreach (var item in x.Branch(path)){
                paths.Add($"{itemPath}:{i}",path);
                i++;
            }
        }
        a = paths;
    }
}
# ---------- end c_script ----------
concat = Concatenate(FragmentA=Slider(0, range=0..1), FragmentB=Slider(0, range=0..4), JoinSeparator=";")
rev = ReverseList(List=c_script.a)
branch = TreeBranch(Tree=gridgenerator, Path=concat, MaintainPaths=True)
item = ListItem(List=branch, Index=Slider(0, range=0..3), Wrap=True)
textdot = DefineTextDot(Text=rev, Location=project.Point, Font="Arial", Size=Slider(18, range=0..100))
preview = CustomPreview(Geometry=textdot, Material=ColourSwatch(SwatchColor=RGB(255, 255, 255)))

flatten_2 = FlattenTree(Tree=project.Point, Path="{0}")
pdecon = Deconstruct(Point=flatten_2)  # -> XComponent, YComponent, ZComponent
item_2 = ListItem(List=flatten, Index=0, Wrap=True)
sort = SortList(Keys=pdecon.ZComponent, ValuesA=pdecon.ZComponent)  # -> Keys, ValuesA
pdecon_2 = Deconstruct(Point=item_2)  # -> XComponent, YComponent, ZComponent
item_3 = ListItem(List=sort.ValuesA, Index=0, Wrap=True)
subtraction = Subtraction(A=pdecon_2.ZComponent, B=item_3)
Z_2 = UnitZ(Factor=subtraction)
move = Move(Geometry=project.Point, Motion=Z_2)  # -> Geometry, Transform
dist = Distance(PointA=clean, PointB=move.Geometry)
flatten_3 = FlattenTree(Tree=dist, Path="{0}")
Z_3 = UnitZ(Factor=dist)

# ----
# controller api server url
# port base (75 -> 7501, 7512, ...)
# api endpoint route
# activate requests
# get current status
# linear actuator specs
fetch_current_value = Button()
max_lin_act_extension_mm = Slider(850, range=0..1000)
send_requests = BooleanToggle(False)

move_2 = Move(Geometry=gridgenerator_2, Motion=Z_3)  # -> Geometry, Transform
sort_2 = SortList(Keys=flatten_3, ValuesA=flatten_3)  # -> Keys, ValuesA
int = Integer(dist)
merge = Merge(Data1=gridgenerator, Data2=move_2.Geometry)
item_4 = ListItem(List=sort_2.ValuesA, Index=0, Wrap=True)  # -> Item1, Item
rev_2 = ReverseList(List=int)
send_targets = Button()
toggle = BooleanToggle(False)
larger = LargerThan(FirstNumber=item_4.Item1, SecondNumber=max_lin_act_extension_mm)  # -> LargerThan, OrEqualTo
c_script_2 = CSharpScript(url="http://127.0.0.1:7500", targets=rev_2, sendTargets=send_targets, FetchCurrent=Toggle(False))  # -> out, current, bundle; inputs url: String, targets: tree of Double, sendTargets: Boolean, FetchCurrent: Boolean
# ---------- c_script_2: C# ----------
// Grasshopper Script Instance
#region Usings
using System;
#r "C:\Users\arastoo\source\repos\agb\linear_actuator\LinearActuator.ClientAPI\bin\Debug\net8.0\LinearActuator.ClientAPI.dll"
#r "C:\Users\arastoo\source\repos\agb\linear_actuator\LinearActuator.ClientAPI\bin\Debug\net8.0\LinearActuator.Core.dll"
using System.Linq;
using System.Collections;
using System.Collections.Generic;
using System.Drawing;
using System.Net.Http;

using Rhino;
using Rhino.Geometry;

using Grasshopper;
using Grasshopper.Kernel;
using Grasshopper.Kernel.Data;
using Grasshopper.Kernel.Types;

using LinearActuator.ClientAPI;
using LinearActuator.Core;
#endregion

public class Script_Instance : GH_ScriptInstance
{
    #region Notes
    /* 
      Members:
        RhinoDoc RhinoDocument
        GH_Document GrasshopperDocument
        IGH_Component Component
        int Iteration

      Methods (Virtual & overridable):
        Print(string text)
        Print(string format, params object[] args)
        Reflect(object obj)
        Reflect(object obj, string method_name)
    */
    #endregion

    ActuatorStateBundle currentState = null;

    private void RunScript(
		string url,
		DataTree<double> targets,
		bool sendTargets,
		bool FetchCurrent,
		ref object current,
		ref object bundle)
    {

        ActuatorStateBundle targetBundle = TargetTreeToBundle(targets); 

        LinearActuatorApiClient client = new(new()){
            BaseUrl = url
        };

        if (sendTargets)
        {
            ActuatorStateBundle response = (ActuatorStateBundle) client.PostActuatorBundlesAsync(targetBundle).GetAwaiter().GetResult();
            RhinoApp.WriteLine(response.ToJson());
        }

        if (FetchCurrent)
        {
            currentState = (ActuatorStateBundle) client.GetActuatorBundlesAsync().GetAwaiter().GetResult();
            RhinoApp.WriteLine(currentState.ToJson());
        }

        current = currentState;
        bundle = targetBundle.ToJson();
    }

    private ActuatorStateBundle TargetTreeToBundle(DataTree<double> targets)
    {
        Dictionary<string, string> tags = new();
        tags.Add("0:0","M01");
        tags.Add("0:1","M02");
        tags.Add("0:2","M03");
        tags.Add("0:3","M04");
        tags.Add("0:4","M05");
        tags.Add("1:0","M06");
        tags.Add("1:1","M07");
        tags.Add("1:2","M08");
        tags.Add("1:3","M09");
        tags.Add("1:4","M10");

        ActuatorStateBundle bundle = new (){
            Modules = new(),
        };
            
        // Write your logic here
        foreach (GH_Path path in targets.Paths){
            ActuatorState actState = new();
            List<double> branch = targets.Branch(path);
            string path_string = string.Join(':',path.Indices);
            for (int i = 0; i < branch.Count; i++)
            {
                switch (i){
                    case 0:
                    actState.A1Target = branch[i];
                    break;
                    case 1:
                    actState.A2Target = branch[i];
                    break;
                    case 2:
                    actState.A3Target = branch[i];
                    break;
                    case 3:
                    actState.A4Target = branch[i];
                    break;
                }
            }
            bundle.Modules.Add(tags[path_string],actState); 
        }

        return bundle;
    }
}
# ---------- end c_script_2 ----------
not = GateNot(A=larger.LargerThan)
filter = StreamFilter(
    Gate=larger.LargerThan,
    Stream0=ColourSwatch(SwatchColor=RGB(84, 84, 84)),
    Stream1=ColourSwatch(SwatchColor=RGB(255, 0, 0)))
relay = Relay()
and = GateAnd(A=not, B=send_requests)
move_3 = Move(Geometry=srf, Motion=Z_2)  # -> Geometry, Transform
preview_2 = CustomPreview(Geometry=merge, Material=filter)
panel = Panel(c_script_2.bundle)
c_script_3 = CSharpScript(url=relay, run=fetch_current_value, submit=send_requests)  # -> out, a, b, c; inputs url: tree of String, submit: Boolean
# ---------- c_script_3: C# ----------
// Grasshopper Script Instance
#region Usings
using System;
using System.Collections.Generic;
using System.Net.Http;
using System.Text.Json;
using Grasshopper.Kernel.Data;
using Grasshopper;
#endregion

public class Script_Instance : GH_ScriptInstance
{
    private static readonly HttpClient HttpClient = new HttpClient
    {
        Timeout = TimeSpan.FromSeconds(15)
    };

    private void RunScript(
		DataTree<string> url,
		object run,
		bool submit,
		ref object a,
		ref object b,
		ref object c)
    {
        var statusCodes = new DataTree<int>();
        var responses = new DataTree<string>();

        if (!submit)
        {
            a = "Idle (set submit=true to send)";
            b = statusCodes;
            c = responses;
            return;
        }

        if (url is null || url.BranchCount == 0)
        {
            a = "Error";
            b = statusCodes;
            responses.Add("url tree must contain at least one branch.", new GH_Path(0));
            c = responses;
            return;
        }

        int successCount = 0;

        try
        {
            foreach (GH_Path path in url.Paths)
            {
                List<string> branch = url.Branch(path);
                if (branch is null || branch.Count == 0 || string.IsNullOrWhiteSpace(branch[0]))
                {
                    statusCodes.Add(-1, path);
                    responses.Add("Branch must contain a non-empty URL.", path);
                    continue;
                }

                string endpoint = branch[0];
                var result = GetActuators(endpoint);

                statusCodes.Add(result.statusCode, path);
                responses.Add(FormatJsonPretty(result.responseBody), path);
                successCount++;
            }

            a = successCount > 0 ? "Sent" : "No valid branches";
            b = statusCodes;
            c = responses;
        }
        catch (Exception ex)
        {
            a = "Error";
            b = statusCodes;
            responses.Add(ex.Message, new GH_Path(0));
            c = responses;
        }
    }

    private static (int statusCode, string responseBody) GetActuators(string url)
    {
        using HttpResponseMessage response = HttpClient.GetAsync(url).Result;
        string responseBody = response.Content.ReadAsStringAsync().Result;
        return ((int)response.StatusCode, responseBody);
    }

    private static string FormatJsonPretty(string json)
    {
        if (string.IsNullOrWhiteSpace(json))
        {
            return json ?? string.Empty;
        }

        try
        {
            using JsonDocument doc = JsonDocument.Parse(json);
            return JsonSerializer.Serialize(doc.RootElement, new JsonSerializerOptions
            {
                WriteIndented = true
            });
        }
        catch
        {
            return json;
        }
    }
}
# ---------- end c_script_3 ----------
c_script_4 = CSharpScript(url=relay, valueTree=rev_2, submit=and)  # -> out, a, b, c; inputs url: tree of String, valueTree: tree of Int32, submit: Boolean
# ---------- c_script_4: C# ----------
// Grasshopper Script Instance
#region Usings
using System;
using System.Collections.Generic;
using System.Net.Http;
using System.Text;
using System.Text.Json;
using Grasshopper.Kernel.Data;
using Grasshopper;
#endregion

public class Script_Instance : GH_ScriptInstance
{
    private static readonly HttpClient HttpClient = new HttpClient
    {
        Timeout = TimeSpan.FromSeconds(15)
    };

    private void RunScript(
		DataTree<string> url,
		DataTree<int> valueTree,
		bool submit,
		ref object a,
		ref object b,
		ref object c)
    {
        var statusCodes = new DataTree<int>();
        var responses = new DataTree<string>();

        if (!submit)
        {
            a = "Idle (set submit=true to send)";
            b = statusCodes;
            c = responses;
            return;
        }


        if (valueTree is null || valueTree.BranchCount == 0)
        {
            a = "Error";
            b = statusCodes;
            responses.Add("valueTree must contain at least one branch.", new GH_Path(0));
            c = responses;
            return;
        }

        int successCount = 0;

        try
        {
            foreach (GH_Path path in valueTree.Paths)
            {
                List<int> branch = valueTree.Branch(path);
                if (branch is null || branch.Count < 4)
                {
                    statusCodes.Add(-1, path);
                    responses.Add("Branch must contain at least 4 target values.", path);
                    continue;
                }

                var body = new
                {
                    a1_target = branch[0],
                    a2_target = branch[1],
                    a3_target = branch[2],
                    a4_target = branch[3],
                };
                var endpoint = url.Branch(path)[0];

                        if (string.IsNullOrWhiteSpace(endpoint))
                        {
                            a = "Error";
                            b = statusCodes;
                            responses.Add("URL input is required.", new GH_Path(0));
                            c = responses;
                            return;
                        }

                string requestBody = JsonSerializer.Serialize(body);
                var result = PostTargets(endpoint, requestBody);

                statusCodes.Add(result.statusCode, path);
                responses.Add(FormatJsonPretty(result.responseBody), path);
                successCount++;
            }

            a = successCount > 0 ? "Sent" : "No valid branches";
            b = statusCodes;
            c = responses;
        }
        catch (Exception ex)
        {
            a = "Error";
            b = statusCodes;
            responses.Add(ex.Message, new GH_Path(0));
            c = responses;
        }
    }

    private static (int statusCode, string responseBody) PostTargets(
        string url,
        string requestBody
    )
    {
        using var content = new StringContent(requestBody, Encoding.UTF8, "application/json");
        using HttpResponseMessage response = HttpClient.PostAsync(url, content).Result;
        string responseBody = response.Content.ReadAsStringAsync().Result;
        return ((int)response.StatusCode, responseBody);
    }

    private static string FormatJsonPretty(string json)
{
    if (string.IsNullOrWhiteSpace(json))
    {
        return json ?? string.Empty;
    }
    try
    {
        using JsonDocument doc = JsonDocument.Parse(json);
        return JsonSerializer.Serialize(doc.RootElement, new JsonSerializerOptions
        {
            WriteIndented = true
        });
    }
    catch
    {
        // If response is not valid JSON, return original text
        return json;
    }
}
}
# ---------- end c_script_4 ----------
c_script_5 = CSharpScript()  # -> out, report, stageTasks, currentMatrix, httpCodes, httpResponses, history; inputs reportUrl: tree of String, commandUrl: tree of String, targetTree: tree of Double, start: Boolean, retry: Boolean, reset: Boolean, maxStepMm: Double, toleranceMm: Double
# ---------- c_script_5: C# ----------
// Grasshopper Script Instance
#region Usings
using System;
using System.Collections.Generic;
using System.Globalization;
using System.Net.Http;
using System.Text;
using System.Text.Json;
using System.Text.RegularExpressions;
using Grasshopper;
using Grasshopper.Kernel.Data;
#endregion

public class Script_Instance : GH_ScriptInstance
{
    // =========================================================
    // HTTP 客户端
    // =========================================================

    private static readonly HttpClient HttpClient = new HttpClient
    {
        Timeout = TimeSpan.FromSeconds(15)
    };

    // =========================================================
    // JSON 字段识别
    //
    // 支持：
    // a1_position
    // a2_current
    // a3_actual
    // a4_pos
    // a1
    // =========================================================

    private static readonly Regex PositionKeyRegex = new Regex(
        @"^a(\d+)(?:_(?:position|pos|current|actual))?$",
        RegexOptions.IgnoreCase | RegexOptions.Compiled
    );

    // =========================================================
    // 任务状态
    // =========================================================

    private enum JobState
    {
        Idle,
        WaitingForStage,
        PausedFault,
        Completed,
        Error
    }

    private JobState _state = JobState.Idle;

    // 每个元素代表一个阶段任务矩阵
    private readonly List<DataTree<double>> _stages =
        new List<DataTree<double>>();

    // 将所有阶段整理为一个数据树
    private DataTree<double> _allStages =
        new DataTree<double>();

    // 最近读取的当前位置矩阵
    private DataTree<double> _currentPositions =
        new DataTree<double>();

    // 最近一次请求状态
    private DataTree<int> _lastStatusCodes =
        new DataTree<int>();

    private DataTree<string> _lastResponses =
        new DataTree<string>();

    // 汇报历史
    private readonly List<string> _log =
        new List<string>();

    // 当前阶段，内部采用 0 起始
    private int _stageIndex = -1;

    // 当前阶段发送时间
    private DateTime _stageSentAtUtc;

    // 当前汇报
    private string _latestReport = "空闲";

    // 按钮上升沿检测
    private bool _previousStart;
    private bool _previousRetry;
    private bool _previousReset;

    // =========================================================
    // Grasshopper 主函数
    // =========================================================

    private void RunScript(
		DataTree<string> reportUrl,
		DataTree<string> commandUrl,
		DataTree<double> targetTree,
		bool start,
		bool retry,
		bool reset,
		double maxStepMm,
		double toleranceMm,
		object tick,
		ref object report,
		ref object stageTasks,
		ref object currentMatrix,
		ref object httpCodes,
		ref object httpResponses,
		ref object history)
    {
        // tick 的数值本身不使用。
        // 它只用于让 Timer 等外部对象触发重新计算。
        object unusedTick = tick;

        // 检测按钮 false → true
        bool startEdge = start && !_previousStart;
        bool retryEdge = retry && !_previousRetry;
        bool resetEdge = reset && !_previousReset;

        _previousStart = start;
        _previousRetry = retry;
        _previousReset = reset;

        // 默认值
        double step = maxStepMm > 0.0
            ? maxStepMm
            : 50.0;

        double tolerance = toleranceMm >= 0.0
            ? toleranceMm
            : 1.0;

        // -----------------------------------------------------
        // 重置
        // -----------------------------------------------------

        if (resetEdge)
        {
            ClearJob();

            _latestReport = "任务已重置。";
            AddLog(_latestReport);

            SetOutputs(
                ref report,
                ref stageTasks,
                ref currentMatrix,
                ref httpCodes,
                ref httpResponses,
                ref history
            );

            return;
        }

        // -----------------------------------------------------
        // 开始新任务
        // -----------------------------------------------------

        if (startEdge)
        {
            StartNewJob(
                reportUrl,
                commandUrl,
                targetTree,
                step
            );

            SetOutputs(
                ref report,
                ref stageTasks,
                ref currentMatrix,
                ref httpCodes,
                ref httpResponses,
                ref history
            );

            return;
        }

        // -----------------------------------------------------
        // 维修完成后重试当前阶段
        // -----------------------------------------------------

        if (_state == JobState.PausedFault && retryEdge)
        {
            RetryCurrentStage(commandUrl);

            SetOutputs(
                ref report,
                ref stageTasks,
                ref currentMatrix,
                ref httpCodes,
                ref httpResponses,
                ref history
            );

            return;
        }

        // -----------------------------------------------------
        // 等待并检查当前阶段
        // -----------------------------------------------------

        if (_state == JobState.WaitingForStage)
        {
            PollCurrentStage(
                reportUrl,
                commandUrl,
                tolerance
            );
        }

        SetOutputs(
            ref report,
            ref stageTasks,
            ref currentMatrix,
            ref httpCodes,
            ref httpResponses,
            ref history
        );
    }

    // =========================================================
    // 开始新任务
    // =========================================================

    private void StartNewJob(
        DataTree<string> reportUrl,
        DataTree<string> commandUrl,
        DataTree<double> targetTree,
        double maxStepMm)
    {
        ClearJob();

        // 检查目标矩阵
        if (targetTree == null || targetTree.BranchCount == 0)
        {
            SetError("目标位置矩阵 targetTree 不能为空。");
            return;
        }

        string error;

        // -----------------------------------------------------
        // 第一步：读取当前位置
        // -----------------------------------------------------

        if (!TryReadCurrentMatrix(
            reportUrl,
            targetTree,
            out error))
        {
            SetError("当前位置数据接收失败：" + error);
            return;
        }

        _latestReport = "完成数据接收。";
        AddLog(_latestReport);

        // -----------------------------------------------------
        // 第二步：分割阶段任务
        // -----------------------------------------------------

        if (!TryBuildStages(
            _currentPositions,
            targetTree,
            maxStepMm,
            out error))
        {
            SetError("任务分割失败：" + error);
            return;
        }

        _latestReport =
            "完成任务分割，共 " +
            _stages.Count +
            " 个阶段。";

        AddLog(_latestReport);

        // -----------------------------------------------------
        // 当前已经到达最终目标
        // -----------------------------------------------------

        if (_stages.Count == 0)
        {
            _state = JobState.Completed;

            _latestReport =
                "所有阶段已完成，当前位置已经等于目标位置。";

            AddLog(_latestReport);
            return;
        }

        // -----------------------------------------------------
        // 发送第一个阶段
        // -----------------------------------------------------

        _stageIndex = 0;

        if (!TrySendStage(
            commandUrl,
            _stages[_stageIndex],
            out error))
        {
            _state = JobState.PausedFault;

            _latestReport =
                "第 1 阶段发送失败，任务已暂停：" +
                error;

            AddLog(_latestReport);
            return;
        }

        _stageSentAtUtc = DateTime.UtcNow;
        _state = JobState.WaitingForStage;

        _latestReport =
            "共 " +
            _stages.Count +
            " 个阶段中的第 1 阶段正在进行。";

        AddLog(_latestReport);
    }

    // =========================================================
    // 定时检查当前阶段
    // =========================================================

    private void PollCurrentStage(
        DataTree<string> reportUrl,
        DataTree<string> commandUrl,
        double toleranceMm)
    {
        if (_stageIndex < 0 ||
            _stageIndex >= _stages.Count)
        {
            SetError("当前阶段编号无效。");
            return;
        }

        DataTree<double> currentStage =
            _stages[_stageIndex];

        string error;

        bool readSuccess = TryReadCurrentMatrix(
            reportUrl,
            currentStage,
            out error
        );

        // -----------------------------------------------------
        // 成功读取现状
        // -----------------------------------------------------

        if (readSuccess)
        {
            bool completed = IsStageComplete(
                _currentPositions,
                currentStage,
                toleranceMm
            );

            if (completed)
            {
                CompleteCurrentStage(commandUrl);
                return;
            }
        }
        else
        {
            _latestReport =
                "共 " +
                _stages.Count +
                " 个阶段中的第 " +
                (_stageIndex + 1) +
                " 阶段正在进行；当前位置读取失败，继续等待：" +
                error;
        }

        // -----------------------------------------------------
        // 判断是否超过 1 分钟
        // -----------------------------------------------------

        TimeSpan elapsed =
            DateTime.UtcNow - _stageSentAtUtc;

        if (elapsed >= TimeSpan.FromMinutes(1))
        {
            _state = JobState.PausedFault;

            _latestReport =
                "线性驱动器可能出现故障，无法完成当前阶段任务。" +
                "当前为共 " +
                _stages.Count +
                " 个阶段中的第 " +
                (_stageIndex + 1) +
                " 阶段。" +
                "任务已暂停，请检查并维修线性驱动器，完成后按下 Retry。";

            AddLog(_latestReport);
            return;
        }

        // 正常等待
        if (readSuccess)
        {
            _latestReport =
                "共 " +
                _stages.Count +
                " 个阶段中的第 " +
                (_stageIndex + 1) +
                " 阶段正在进行。";
        }
    }

    // =========================================================
    // 完成当前阶段并发送下一阶段
    // =========================================================

    private void CompleteCurrentStage(
        DataTree<string> commandUrl)
    {
        _latestReport =
            "共 " +
            _stages.Count +
            " 个阶段中的第 " +
            (_stageIndex + 1) +
            " 阶段完成。";

        AddLog(_latestReport);

        // -----------------------------------------------------
        // 所有阶段完成
        // -----------------------------------------------------

        if (_stageIndex >= _stages.Count - 1)
        {
            _state = JobState.Completed;

            _latestReport =
                "所有阶段已完成。";

            AddLog(_latestReport);
            return;
        }

        // -----------------------------------------------------
        // 发送下一阶段
        // -----------------------------------------------------

        _stageIndex++;

        string error;

        if (!TrySendStage(
            commandUrl,
            _stages[_stageIndex],
            out error))
        {
            _state = JobState.PausedFault;

            _latestReport =
                "第 " +
                (_stageIndex + 1) +
                " 阶段发送失败，任务已暂停：" +
                error;

            AddLog(_latestReport);
            return;
        }

        _stageSentAtUtc = DateTime.UtcNow;
        _state = JobState.WaitingForStage;

        _latestReport =
            "共 " +
            _stages.Count +
            " 个阶段中的第 " +
            (_stageIndex + 1) +
            " 阶段正在进行。";

        AddLog(_latestReport);
    }

    // =========================================================
    // 重发当前阶段
    // =========================================================

    private void RetryCurrentStage(
        DataTree<string> commandUrl)
    {
        if (_stageIndex < 0 ||
            _stageIndex >= _stages.Count)
        {
            SetError("没有可以重试的阶段任务。");
            return;
        }

        string error;

        if (!TrySendStage(
            commandUrl,
            _stages[_stageIndex],
            out error))
        {
            _state = JobState.PausedFault;

            _latestReport =
                "当前阶段重新发送失败，任务继续保持暂停：" +
                error;

            AddLog(_latestReport);
            return;
        }

        _stageSentAtUtc = DateTime.UtcNow;
        _state = JobState.WaitingForStage;

        _latestReport =
            "重新发送当前任务：共 " +
            _stages.Count +
            " 个阶段中的第 " +
            (_stageIndex + 1) +
            " 阶段正在进行。";

        AddLog(_latestReport);
    }

    // =========================================================
    // 任务分割
    // =========================================================

    private bool TryBuildStages(
        DataTree<double> currentTree,
        DataTree<double> targetTree,
        double maxStepMm,
        out string error)
    {
        error = string.Empty;

        _stages.Clear();
        _allStages = new DataTree<double>();

        if (maxStepMm <= 0.0)
        {
            error = "maxStepMm 必须大于 0。";
            return false;
        }

        int stageCount = 0;

        // -----------------------------------------------------
        // 计算整个矩阵需要多少阶段
        // -----------------------------------------------------

        foreach (GH_Path path in targetTree.Paths)
        {
            if (!currentTree.PathExists(path))
            {
                error =
                    "当前位置矩阵缺少路径 " +
                    path +
                    "。";

                return false;
            }

            List<double> currentBranch =
                currentTree.Branch(path);

            List<double> targetBranch =
                targetTree.Branch(path);

            if (currentBranch == null ||
                targetBranch == null ||
                currentBranch.Count != targetBranch.Count)
            {
                error =
                    "路径 " +
                    path +
                    " 的当前位置数量与目标位置数量不一致。";

                return false;
            }

            for (int i = 0; i < targetBranch.Count; i++)
            {
                double distance = Math.Abs(
                    targetBranch[i] - currentBranch[i]
                );

                int requiredStages = (int)Math.Ceiling(
                    distance / maxStepMm
                );

                if (requiredStages > stageCount)
                {
                    stageCount = requiredStages;
                }
            }
        }

        // 无需移动
        if (stageCount == 0)
        {
            return true;
        }

        // -----------------------------------------------------
        // 生成每个阶段的位置矩阵
        // -----------------------------------------------------

        for (int stage = 1; stage <= stageCount; stage++)
        {
            DataTree<double> stageTree =
                new DataTree<double>();

            foreach (GH_Path path in targetTree.Paths)
            {
                List<double> currentBranch =
                    currentTree.Branch(path);

                List<double> targetBranch =
                    targetTree.Branch(path);

                for (int i = 0; i < targetBranch.Count; i++)
                {
                    double startValue = currentBranch[i];
                    double targetValue = targetBranch[i];
                    double delta = targetValue - startValue;

                    double moveDistance = Math.Min(
                        Math.Abs(delta),
                        maxStepMm * stage
                    );

                    double stageValue;

                    if (Math.Abs(delta) <= moveDistance)
                    {
                        // 已经达到目标，后续阶段保持目标值
                        stageValue = targetValue;
                    }
                    else
                    {
                        stageValue =
                            startValue +
                            Math.Sign(delta) * moveDistance;
                    }

                    stageTree.Add(stageValue, path);
                }
            }

            _stages.Add(stageTree);

            // -------------------------------------------------
            // 汇总阶段数据树
            //
            // 原路径 {0}
            // 变为：
            // 阶段 1 → {1;0}
            // 阶段 2 → {2;0}
            // -------------------------------------------------

            foreach (GH_Path path in stageTree.Paths)
            {
                GH_Path outputPath =
                    PrependPath(stage, path);

                List<double> values =
                    stageTree.Branch(path);

                for (int i = 0; i < values.Count; i++)
                {
                    _allStages.Add(
                        values[i],
                        outputPath
                    );
                }
            }
        }

        return true;
    }

    // =========================================================
    // 判断阶段是否完成
    // =========================================================

    private bool IsStageComplete(
        DataTree<double> currentTree,
        DataTree<double> stageTarget,
        double toleranceMm)
    {
        foreach (GH_Path path in stageTarget.Paths)
        {
            if (!currentTree.PathExists(path))
            {
                return false;
            }

            List<double> currentBranch =
                currentTree.Branch(path);

            List<double> targetBranch =
                stageTarget.Branch(path);

            if (currentBranch == null ||
                targetBranch == null ||
                currentBranch.Count < targetBranch.Count)
            {
                return false;
            }

            for (int i = 0; i < targetBranch.Count; i++)
            {
                double difference = Math.Abs(
                    currentBranch[i] - targetBranch[i]
                );

                if (difference > toleranceMm)
                {
                    return false;
                }
            }
        }

        return true;
    }

    // =========================================================
    // GET：读取当前位置矩阵
    // =========================================================

    private bool TryReadCurrentMatrix(
        DataTree<string> reportUrl,
        DataTree<double> shapeTemplate,
        out string error)
    {
        error = string.Empty;

        DataTree<double> resultTree =
            new DataTree<double>();

        DataTree<int> statusCodes =
            new DataTree<int>();

        DataTree<string> responses =
            new DataTree<string>();

        if (reportUrl == null ||
            reportUrl.BranchCount == 0)
        {
            error = "reportUrl 不能为空。";
            return false;
        }

        foreach (GH_Path path in shapeTemplate.Paths)
        {
            string endpoint;

            if (!TryGetUrl(
                reportUrl,
                path,
                out endpoint))
            {
                statusCodes.Add(-1, path);
                responses.Add(
                    "路径中缺少有效的状态读取 URL。",
                    path
                );

                _lastStatusCodes = statusCodes;
                _lastResponses = responses;

                error =
                    "路径 " +
                    path +
                    " 中缺少有效的 reportUrl。";

                return false;
            }

            try
            {
                var httpResult =
                    GetActuators(endpoint);

                statusCodes.Add(
                    httpResult.statusCode,
                    path
                );

                responses.Add(
                    FormatJsonPretty(
                        httpResult.responseBody
                    ),
                    path
                );

                if (httpResult.statusCode < 200 ||
                    httpResult.statusCode >= 300)
                {
                    _lastStatusCodes = statusCodes;
                    _lastResponses = responses;

                    error =
                        "GET 请求返回 HTTP " +
                        httpResult.statusCode +
                        "，路径：" +
                        path;

                    return false;
                }

                List<double> positions;

                if (!TryParsePositions(
                    httpResult.responseBody,
                    out positions))
                {
                    _lastStatusCodes = statusCodes;
                    _lastResponses = responses;

                    error =
                        "无法从路径 " +
                        path +
                        " 的 JSON 中解析当前位置。";

                    return false;
                }

                List<double> templateBranch =
                    shapeTemplate.Branch(path);

                int expectedCount =
                    templateBranch == null
                    ? 0
                    : templateBranch.Count;

                if (positions.Count < expectedCount)
                {
                    _lastStatusCodes = statusCodes;
                    _lastResponses = responses;

                    error =
                        "路径 " +
                        path +
                        " 返回了 " +
                        positions.Count +
                        " 个位置，但目标矩阵需要 " +
                        expectedCount +
                        " 个位置。";

                    return false;
                }

                // 恢复成与目标矩阵相同的路径和数量
                for (int i = 0; i < expectedCount; i++)
                {
                    resultTree.Add(
                        positions[i],
                        path
                    );
                }
            }
            catch (Exception ex)
            {
                statusCodes.Add(-2, path);
                responses.Add(ex.Message, path);

                _lastStatusCodes = statusCodes;
                _lastResponses = responses;

                error =
                    "读取路径 " +
                    path +
                    " 时发生错误：" +
                    ex.Message;

                return false;
            }
        }

        _currentPositions = resultTree;
        _lastStatusCodes = statusCodes;
        _lastResponses = responses;

        return true;
    }

    // =========================================================
    // POST：发送一个阶段任务
    // =========================================================

    private bool TrySendStage(
        DataTree<string> commandUrl,
        DataTree<double> stageTree,
        out string error)
    {
        error = string.Empty;

        DataTree<int> statusCodes =
            new DataTree<int>();

        DataTree<string> responses =
            new DataTree<string>();

        if (commandUrl == null ||
            commandUrl.BranchCount == 0)
        {
            error = "commandUrl 不能为空。";
            return false;
        }

        foreach (GH_Path path in stageTree.Paths)
        {
            string endpoint;

            if (!TryGetUrl(
                commandUrl,
                path,
                out endpoint))
            {
                statusCodes.Add(-1, path);
                responses.Add(
                    "路径中缺少有效的任务发送 URL。",
                    path
                );

                _lastStatusCodes = statusCodes;
                _lastResponses = responses;

                error =
                    "路径 " +
                    path +
                    " 中缺少有效的 commandUrl。";

                return false;
            }

            List<double> branch =
                stageTree.Branch(path);

            if (branch == null ||
                branch.Count == 0)
            {
                error =
                    "阶段任务路径 " +
                    path +
                    " 中没有目标值。";

                return false;
            }

            // 动态生成：
            // a1_target
            // a2_target
            // a3_target
            // ...
            Dictionary<string, double> body =
                new Dictionary<string, double>();

            for (int i = 0; i < branch.Count; i++)
            {
                string key =
                    "a" +
                    (i + 1) +
                    "_target";

                body[key] = branch[i];
            }

            string requestBody =
                JsonSerializer.Serialize(body);

            try
            {
                var httpResult = PostTargets(
                    endpoint,
                    requestBody
                );

                statusCodes.Add(
                    httpResult.statusCode,
                    path
                );

                responses.Add(
                    FormatJsonPretty(
                        httpResult.responseBody
                    ),
                    path
                );

                if (httpResult.statusCode < 200 ||
                    httpResult.statusCode >= 300)
                {
                    _lastStatusCodes = statusCodes;
                    _lastResponses = responses;

                    error =
                        "POST 请求返回 HTTP " +
                        httpResult.statusCode +
                        "，路径：" +
                        path;

                    return false;
                }
            }
            catch (Exception ex)
            {
                statusCodes.Add(-2, path);
                responses.Add(ex.Message, path);

                _lastStatusCodes = statusCodes;
                _lastResponses = responses;

                error =
                    "发送路径 " +
                    path +
                    " 时发生错误：" +
                    ex.Message;

                return false;
            }
        }

        _lastStatusCodes = statusCodes;
        _lastResponses = responses;

        return true;
    }

    // =========================================================
    // HTTP 方法
    // =========================================================

    private static (
        int statusCode,
        string responseBody
    ) GetActuators(string url)
    {
        using HttpResponseMessage response =
            HttpClient
                .GetAsync(url)
                .GetAwaiter()
                .GetResult();

        string responseBody =
            response.Content
                .ReadAsStringAsync()
                .GetAwaiter()
                .GetResult();

        return (
            (int)response.StatusCode,
            responseBody
        );
    }

    private static (
        int statusCode,
        string responseBody
    ) PostTargets(
        string url,
        string requestBody)
    {
        using var content = new StringContent(
            requestBody,
            Encoding.UTF8,
            "application/json"
        );

        using HttpResponseMessage response =
            HttpClient
                .PostAsync(url, content)
                .GetAwaiter()
                .GetResult();

        string responseBody =
            response.Content
                .ReadAsStringAsync()
                .GetAwaiter()
                .GetResult();

        return (
            (int)response.StatusCode,
            responseBody
        );
    }

    // =========================================================
    // JSON 当前位置解析
    // =========================================================

    private static bool TryParsePositions(
        string json,
        out List<double> positions)
    {
        positions = new List<double>();

        if (string.IsNullOrWhiteSpace(json))
        {
            return false;
        }

        try
        {
            using JsonDocument document =
                JsonDocument.Parse(json);

            return TryExtractPositionValues(
                document.RootElement,
                out positions
            );
        }
        catch
        {
            return false;
        }
    }

    private static bool TryExtractPositionValues(
        JsonElement element,
        out List<double> values)
    {
        values = new List<double>();

        // -----------------------------------------------------
        // 单个数字
        // -----------------------------------------------------

        double singleValue;

        if (TryGetNumber(element, out singleValue))
        {
            values.Add(singleValue);
            return true;
        }

        // -----------------------------------------------------
        // JSON 数组
        //
        // [10, 20, 30, 40]
        //
        // 或：
        //
        // [
        //   {"position": 10},
        //   {"position": 20}
        // ]
        // -----------------------------------------------------

        if (element.ValueKind == JsonValueKind.Array)
        {
            foreach (JsonElement item in element.EnumerateArray())
            {
                double number;

                if (TryGetNumber(item, out number))
                {
                    values.Add(number);
                    continue;
                }

                if (item.ValueKind == JsonValueKind.Object &&
                    TryGetObjectPosition(
                        item,
                        out number))
                {
                    values.Add(number);
                    continue;
                }

                return false;
            }

            return values.Count > 0;
        }

        // -----------------------------------------------------
        // JSON 对象
        // -----------------------------------------------------

        if (element.ValueKind != JsonValueKind.Object)
        {
            return false;
        }

        // 支持包装字段
        string[] wrapperNames =
        {
            "positions",
            "position",
            "current_positions",
            "actual_positions",
            "actuators",
            "data",
            "result"
        };

        for (int i = 0; i < wrapperNames.Length; i++)
        {
            JsonElement wrapped;

            if (TryGetPropertyIgnoreCase(
                element,
                wrapperNames[i],
                out wrapped))
            {
                List<double> wrappedValues;

                if (TryExtractPositionValues(
                    wrapped,
                    out wrappedValues))
                {
                    values = wrappedValues;
                    return true;
                }
            }
        }

        // 支持：
        // {
        //   "a1_position": 10,
        //   "a2_position": 20,
        //   "a3_position": 30
        // }
        List<IndexedValue> indexedValues =
            new List<IndexedValue>();

        foreach (
            JsonProperty property
            in element.EnumerateObject())
        {
            Match match =
                PositionKeyRegex.Match(property.Name);

            if (!match.Success)
            {
                continue;
            }

            int index;

            if (!int.TryParse(
                match.Groups[1].Value,
                out index))
            {
                continue;
            }

            double number;

            if (!TryGetNumber(
                property.Value,
                out number))
            {
                continue;
            }

            indexedValues.Add(
                new IndexedValue(index, number)
            );
        }

        if (indexedValues.Count == 0)
        {
            return false;
        }

        indexedValues.Sort(
            delegate (
                IndexedValue x,
                IndexedValue y)
            {
                return x.Index.CompareTo(y.Index);
            }
        );

        for (int i = 0; i < indexedValues.Count; i++)
        {
            values.Add(indexedValues[i].Value);
        }

        return true;
    }

    private struct IndexedValue
    {
        public int Index;
        public double Value;

        public IndexedValue(
            int index,
            double value)
        {
            Index = index;
            Value = value;
        }
    }

    private static bool TryGetObjectPosition(
        JsonElement element,
        out double value)
    {
        value = 0.0;

        string[] names =
        {
            "position",
            "pos",
            "current",
            "actual",
            "value"
        };

        for (int i = 0; i < names.Length; i++)
        {
            JsonElement property;

            if (TryGetPropertyIgnoreCase(
                element,
                names[i],
                out property) &&
                TryGetNumber(
                    property,
                    out value))
            {
                return true;
            }
        }

        return false;
    }

    private static bool TryGetPropertyIgnoreCase(
        JsonElement element,
        string propertyName,
        out JsonElement value)
    {
        foreach (
            JsonProperty property
            in element.EnumerateObject())
        {
            if (string.Equals(
                property.Name,
                propertyName,
                StringComparison.OrdinalIgnoreCase))
            {
                value = property.Value;
                return true;
            }
        }

        value = default(JsonElement);
        return false;
    }

    private static bool TryGetNumber(
        JsonElement element,
        out double value)
    {
        value = 0.0;

        if (element.ValueKind ==
            JsonValueKind.Number)
        {
            return element.TryGetDouble(out value);
        }

        if (element.ValueKind ==
            JsonValueKind.String)
        {
            string text = element.GetString();

            return double.TryParse(
                text,
                NumberStyles.Float,
                CultureInfo.InvariantCulture,
                out value
            );
        }

        return false;
    }

    // =========================================================
    // URL 和路径工具
    // =========================================================

    private static bool TryGetUrl(
        DataTree<string> urlTree,
        GH_Path path,
        out string endpoint)
    {
        endpoint = string.Empty;

        if (urlTree == null ||
            !urlTree.PathExists(path))
        {
            return false;
        }

        List<string> branch =
            urlTree.Branch(path);

        if (branch == null ||
            branch.Count == 0 ||
            string.IsNullOrWhiteSpace(branch[0]))
        {
            return false;
        }

        endpoint = branch[0].Trim();
        return true;
    }

    private static GH_Path PrependPath(
        int stage,
        GH_Path originalPath)
    {
        int[] originalIndices =
            originalPath.Indices;

        int[] newIndices =
            new int[originalIndices.Length + 1];

        newIndices[0] = stage;

        for (int i = 0;
             i < originalIndices.Length;
             i++)
        {
            newIndices[i + 1] =
                originalIndices[i];
        }

        return new GH_Path(newIndices);
    }

    // =========================================================
    // JSON 格式化
    // =========================================================

    private static string FormatJsonPretty(
        string json)
    {
        if (string.IsNullOrWhiteSpace(json))
        {
            return json ?? string.Empty;
        }

        try
        {
            using JsonDocument document =
                JsonDocument.Parse(json);

            return JsonSerializer.Serialize(
                document.RootElement,
                new JsonSerializerOptions
                {
                    WriteIndented = true
                }
            );
        }
        catch
        {
            return json;
        }
    }

    // =========================================================
    // 状态管理
    // =========================================================

    private void ClearJob()
    {
        _state = JobState.Idle;
        _stageIndex = -1;

        _stages.Clear();

        _allStages =
            new DataTree<double>();

        _currentPositions =
            new DataTree<double>();

        _lastStatusCodes =
            new DataTree<int>();

        _lastResponses =
            new DataTree<string>();

        _log.Clear();

        _latestReport = "空闲";
    }

    private void SetError(string message)
    {
        _state = JobState.Error;
        _latestReport = "错误：" + message;
        AddLog(_latestReport);
    }

    private void AddLog(string message)
    {
        string time =
            DateTime.Now.ToString("HH:mm:ss");

        _log.Add(
            "[" +
            time +
            "] " +
            message
        );
    }

    private void SetOutputs(
        ref object report,
        ref object stageTasks,
        ref object currentMatrix,
        ref object httpCodes,
        ref object httpResponses,
        ref object history)
    {
        report = _latestReport;
        stageTasks = _allStages;
        currentMatrix = _currentPositions;
        httpCodes = _lastStatusCodes;
        httpResponses = _lastResponses;
        history = new List<string>(_log);
    }
}
# ---------- end c_script_5 ----------

panel_2 = Panel(rev_2)
panel_3 = Panel(c_script_4.c)

# ==== cluster GridGenerator
object = ClusterInput()
relay = ClusterInput()
N = ClusterInput()
N_2 = ClusterInput()
F = ClusterInput()
A = ClusterInput()
Y = UnitY(Factor=F)
X = UnitX(Factor=F)
multiplication = Multiplication(A=A, B=Y)
vec = Vector(relay)
object_2 = ModelObject(object)
move = Move(Geometry=object_2, Motion=vec)  # -> Geometry, Transform
arrlinear = LinearArray(Geometry=relay, Direction=X, Count=N)  # -> Geometry, Transform
arrlinear_2 = LinearArray(Geometry=relay, Direction=Y, Count=N_2)  # -> Geometry, Transform
move_2 = Move(Geometry=move.Geometry, Motion=multiplication)  # -> Geometry, Transform
merge = Merge(Data1=move.Geometry, Data2=move_2.Geometry)
graft = GraftTree(Tree=merge, IncludeEmptyLists=True, IncludeNullItems=True)
transform = Transform(Geometry=graft, Transform=arrlinear.Transform)
graft_2 = GraftTree(Tree=transform, IncludeEmptyLists=True, IncludeNullItems=True)
transform_2 = Transform(Geometry=graft_2, Transform=arrlinear_2.Transform)
simplify = SimplifyTree(Tree=transform_2, Front=False)
T = ClusterOutput(simplify)
