# Grasshopper definition linear_actuator_get_client.ghx (Grasshopper 1.0.8)
# plug-ins: eleFront

max_lin_act_extension_mm = Slider(800, range=0..1000)

srf = Surface(<surface referenced from the Rhino model>)
block_definition = ModelBlockDefinition(<model block definition referenced from the Rhino model>)
number_slider = Slider(5, range=0..10)
number_slider_2 = Slider(4, range=0..10)
number_slider_3 = Slider(450, range=0..1000)
number_slider_4 = Slider(4, range=0..10)
pt = Point(<point referenced from the Rhino model>)
block_definition_2 = ModelBlockDefinition(<model block definition referenced from the Rhino model>)
pt_2 = Point(Point(192.0000015, 144.1598235, 60.66119645))
gridgenerator = GridGenerator(object=block_definition, relay=pt_2, N=number_slider, N_2=number_slider_2, F=number_slider_3, A=number_slider_4)
gridgenerator_2 = GridGenerator(object=block_definition_2, relay=pt, N=number_slider, N_2=number_slider_2, F=number_slider_3, A=number_slider_4)
prjtargetextend = CSharpScript(x=srf)  # -> out, a; inputs x: Surface
# ---------- prjtargetextend: C# ----------
// Grasshopper Script Instance
#region Usings
using System;
using System.Linq;
using System.Collections;
using System.Collections.Generic;
using System.Drawing;

using Rhino;
using Rhino.Geometry;

using Grasshopper;
using Grasshopper.Kernel;
using Grasshopper.Kernel.Data;
using Grasshopper.Kernel.Types;
#endregion

public class Script_Instance : GH_ScriptInstance
{
    #region Notes
    /* 
      Members:
        RhinoDoc RhinoDocument
        GH_Document GrasshopperDocument
        IGH_Component Component
        int Iteration

      Methods (Virtual & overridable):
        Print(string text)
        Print(string format, params object[] args)
        Reflect(object obj)
        Reflect(object obj, string method_name)
    */
    #endregion

    private void RunScript(Surface x, ref object a)
    {
        // Write your logic here
        var srv01 = x.Extend(IsoStatus.East,100,true).Extend(IsoStatus.West,100,true);
        var srv02 = srv01.Extend(IsoStatus.North,100,true).Extend(IsoStatus.South,100,true);
        a = srv02;
    }
}
# ---------- end prjtargetextend ----------
pt_3 = Point(gridgenerator_2)
clean = CleanTree(RemoveNulls=True, RemoveInvalid=True, RemoveEmpty=False, Tree=pt_3)
Z = UnitZ(Factor=1)
flatten = FlattenTree(Tree=clean, Path="{0}")
project = ProjectPoint(Point=clean, Direction=Z, Geometry=prjtargetextend.a)  # -> Point, Index

c_script = CSharpScript(x=gridgenerator)  # -> out, a; inputs x: tree
# ---------- c_script: C# ----------
// Grasshopper Script Instance
#region Usings
using System;
using System.Linq;
using System.Collections;
using System.Collections.Generic;
using System.Drawing;

using Rhino;
using Rhino.Geometry;

using Grasshopper;
using Grasshopper.Kernel;
using Grasshopper.Kernel.Data;
using Grasshopper.Kernel.Types;
#endregion

public class Script_Instance : GH_ScriptInstance
{
    #region Notes
    /* 
      Members:
        RhinoDoc RhinoDocument
        GH_Document GrasshopperDocument
        IGH_Component Component
        int Iteration

      Methods (Virtual & overridable):
        Print(string text)
        Print(string format, params object[] args)
        Reflect(object obj)
        Reflect(object obj, string method_name)
    */
    #endregion

    private void RunScript(DataTree<object> x, object y, ref object a)
    {
        // Write your logic here
        DataTree<string> paths= new();
        foreach (var path in x.Paths){
            string itemPath = string.Join(":", path.Indices);
            int i = 0;
            foreach (var item in x.Branch(path)){
                paths.Add($"{itemPath}:{i}",path);
                i++;
            }
        }
        a = paths;
    }
}
# ---------- end c_script ----------
rev = ReverseList(List=c_script.a)
concat = Concatenate(FragmentA=Slider(0, range=0..1), FragmentB=Slider(0, range=0..4), JoinSeparator=";")
branch = TreeBranch(Tree=gridgenerator, Path=concat, MaintainPaths=True)
item = ListItem(List=branch, Index=Slider(0, range=0..3), Wrap=True)
textdot = DefineTextDot(Text=rev, Location=project.Point, Font="Arial", Size=Slider(18, range=0..100))
preview = CustomPreview(Geometry=textdot, Material=ColourSwatch(SwatchColor=RGB(255, 255, 255)))

flatten_2 = FlattenTree(Tree=project.Point, Path="{0}")
pdecon = Deconstruct(Point=flatten_2)  # -> XComponent, YComponent, ZComponent
item_2 = ListItem(List=flatten, Index=0, Wrap=True)
sort = SortList(Keys=pdecon.ZComponent, ValuesA=pdecon.ZComponent)  # -> Keys, ValuesA
pdecon_2 = Deconstruct(Point=item_2)  # -> XComponent, YComponent, ZComponent
item_3 = ListItem(List=sort.ValuesA, Index=0, Wrap=True)
subtraction = Subtraction(A=pdecon_2.ZComponent, B=item_3)
Z_2 = UnitZ(Factor=subtraction)
move = Move(Geometry=project.Point, Motion=Z_2)  # -> Geometry, Transform
dist = Distance(PointA=clean, PointB=move.Geometry)
Z_3 = UnitZ(Factor=dist)
flatten_3 = FlattenTree(Tree=dist, Path="{0}")
sort_2 = SortList(Keys=flatten_3, ValuesA=flatten_3)  # -> Keys, ValuesA
move_2 = Move(Geometry=gridgenerator_2, Motion=Z_3)  # -> Geometry, Transform
int = Integer(dist)
item_4 = ListItem(List=sort_2.ValuesA, Index=0, Wrap=True)  # -> Item1, Item
rev_2 = ReverseList(List=int)
larger = LargerThan(FirstNumber=item_4.Item1, SecondNumber=max_lin_act_extension_mm)  # -> LargerThan, OrEqualTo
merge = Merge(Data1=gridgenerator, Data2=move_2.Geometry)

trigger = Trigger(Interval=500, TimerInterval=500, Target=c_script_2)  # disabled
send_targets = Button()
readcurrent = BooleanToggle(True)
c_script_2 = CSharpScript(url="http://127.0.0.1:7500", targets=rev_2, sendTargets=send_targets, FetchCurrent=readcurrent)  # -> out, current, bundle; inputs url: String, targets: tree of Double, sendTargets: Boolean, FetchCurrent: Boolean
# ---------- c_script_2: C# ----------
// Grasshopper Script Instance
#region Usings
using System;
#r "C:\Users\arastoo\source\repos\agb\linear_actuator\LinearActuator.ClientAPI\bin\Debug\net8.0\LinearActuator.ClientAPI.dll"
#r "C:\Users\arastoo\source\repos\agb\linear_actuator\LinearActuator.ClientAPI\bin\Debug\net8.0\LinearActuator.Core.dll"
using System.Linq;
using System.Collections;
using System.Collections.Generic;
using System.Drawing;
using System.Net.Http;

using Rhino;
using Rhino.Geometry;

using Grasshopper;
using Grasshopper.Kernel;
using Grasshopper.Kernel.Data;
using Grasshopper.Kernel.Types;

using LinearActuator.ClientAPI;
using LinearActuator.Core;
#endregion

public class Script_Instance : GH_ScriptInstance
{
    #region Notes
    /* 
      Members:
        RhinoDoc RhinoDocument
        GH_Document GrasshopperDocument
        IGH_Component Component
        int Iteration

      Methods (Virtual & overridable):
        Print(string text)
        Print(string format, params object[] args)
        Reflect(object obj)
        Reflect(object obj, string method_name)
    */
    #endregion

    ActuatorStateBundle currentState = null;

    private void RunScript(
		string url,
		DataTree<double> targets,
		bool sendTargets,
		bool FetchCurrent,
		ref object current,
		ref object bundle)
    {

        ActuatorStateBundle targetBundle = TargetTreeToBundle(targets); 

        LinearActuatorApiClient client = new(new()){
            BaseUrl = url
        };

        if (sendTargets)
        {
            ActuatorStateBundle response = (ActuatorStateBundle) client.PostActuatorBundlesAsync(targetBundle).GetAwaiter().GetResult();
            // RhinoApp.WriteLine(response.ToJson());
        }

        if (FetchCurrent)
        {
            currentState = (ActuatorStateBundle) client.GetActuatorBundlesAsync().GetAwaiter().GetResult();
            // RhinoApp.WriteLine(currentState.ToJson());
        }

        current = currentState.ToJson();
        bundle = targetBundle.ToJson();
    }

    private ActuatorStateBundle TargetTreeToBundle(DataTree<double> targets)
    {
        Dictionary<string, string> tags = new();
        tags.Add("0:0","M01");
        tags.Add("0:1","M02");
        tags.Add("0:2","M03");
        tags.Add("0:3","M04");
        tags.Add("0:4","M05");
        tags.Add("1:0","M06");
        tags.Add("1:1","M07");
        tags.Add("1:2","M08");
        tags.Add("1:3","M09");
        tags.Add("1:4","M10");

        ActuatorStateBundle bundle = new (){
            Modules = new(),
        };
            
        // Write your logic here
        foreach (GH_Path path in targets.Paths){
            ActuatorState actState = new();
            List<double> branch = targets.Branch(path);
            string path_string = string.Join(':',path.Indices);
            for (int i = 0; i < branch.Count; i++)
            {
                switch (i){
                    case 0:
                    actState.A1Target = branch[i];
                    break;
                    case 1:
                    actState.A2Target = branch[i];
                    break;
                    case 2:
                    actState.A3Target = branch[i];
                    break;
                    case 3:
                    actState.A4Target = branch[i];
                    break;
                }
            }
            bundle.Modules.Add(tags[path_string],actState); 
        }

        return bundle;
    }
}
# ---------- end c_script_2 ----------

filter = StreamFilter(
    Gate=larger.LargerThan,
    Stream0=ColourSwatch(SwatchColor=RGBA(84, 84, 84, 200)),
    Stream1=ColourSwatch(SwatchColor=RGBA(255, 0, 0, 150)))
filter_2 = StreamFilter(
    Gate=larger.LargerThan,
    Stream0=ColourSwatch(SwatchColor=RGB(84, 84, 84)),
    Stream1=ColourSwatch(SwatchColor=RGB(255, 0, 0)))
move_3 = Move(Geometry=srf, Motion=Z_2)  # -> Geometry, Transform
preview_2 = CustomPreview(Geometry=move_3.Geometry, Material=filter)
preview_3 = CustomPreview(Geometry=merge, Material=filter_2)

panel = Panel(c_script_2.current)

# ==== cluster GridGenerator
object = ClusterInput()
relay = ClusterInput()
N = ClusterInput()
N_2 = ClusterInput()
F = ClusterInput()
A = ClusterInput()
Y = UnitY(Factor=F)
X = UnitX(Factor=F)
multiplication = Multiplication(A=A, B=Y)
vec = Vector(relay)
object_2 = ModelObject(object)
move = Move(Geometry=object_2, Motion=vec)  # -> Geometry, Transform
arrlinear = LinearArray(Geometry=relay, Direction=X, Count=N)  # -> Geometry, Transform
arrlinear_2 = LinearArray(Geometry=relay, Direction=Y, Count=N_2)  # -> Geometry, Transform
move_2 = Move(Geometry=move.Geometry, Motion=multiplication)  # -> Geometry, Transform
merge = Merge(Data1=move.Geometry, Data2=move_2.Geometry)
graft = GraftTree(Tree=merge, IncludeEmptyLists=True, IncludeNullItems=True)
transform = Transform(Geometry=graft, Transform=arrlinear.Transform)
graft_2 = GraftTree(Tree=transform, IncludeEmptyLists=True, IncludeNullItems=True)
transform_2 = Transform(Geometry=graft_2, Transform=arrlinear_2.Transform)
simplify = SimplifyTree(Tree=transform_2, Front=False)
T = ClusterOutput(simplify)
