# Grasshopper definition linear_actuator_get_client.gh (Grasshopper 1.0.8)
# plug-ins: eleFront

srf = Surface(<surface referenced from the Rhino model>)
block_definition = ModelBlockDefinition(<model block definition referenced from the Rhino model>)
number_slider = Slider(5, range=0..10)
number_slider_2 = Slider(4, range=0..10)
number_slider_3 = Slider(450, range=0..1000)
number_slider_4 = Slider(4, range=0..10)
block_definition_2 = ModelBlockDefinition(<model block definition referenced from the Rhino model>)
pt = Point(<point referenced from the Rhino model>)
pt_2 = Point(Point(192.0000015, 144.1598235, 60.66119645))
gridgenerator = GridGenerator(object=block_definition, relay=pt_2, N=number_slider, N_2=number_slider_2, F=number_slider_3, A=number_slider_4)
gridgenerator_2 = GridGenerator(object=block_definition_2, relay=pt, N=number_slider, N_2=number_slider_2, F=number_slider_3, A=number_slider_4)
prjtargetextend = CSharpScript(x=srf)  # -> out, a; inputs x: Surface
# ---------- prjtargetextend: C# ----------
// Grasshopper Script Instance
#region Usings
using System;
using System.Linq;
using System.Collections;
using System.Collections.Generic;
using System.Drawing;

using Rhino;
using Rhino.Geometry;

using Grasshopper;
using Grasshopper.Kernel;
using Grasshopper.Kernel.Data;
using Grasshopper.Kernel.Types;
#endregion

public class Script_Instance : GH_ScriptInstance
{
    #region Notes
    /* 
      Members:
        RhinoDoc RhinoDocument
        GH_Document GrasshopperDocument
        IGH_Component Component
        int Iteration

      Methods (Virtual & overridable):
        Print(string text)
        Print(string format, params object[] args)
        Reflect(object obj)
        Reflect(object obj, string method_name)
    */
    #endregion

    private void RunScript(Surface x, ref object a)
    {
        // Write your logic here
        var srv01 = x.Extend(IsoStatus.East,100,true).Extend(IsoStatus.West,100,true);
        var srv02 = srv01.Extend(IsoStatus.North,100,true).Extend(IsoStatus.South,100,true);
        a = srv02;
    }
}
# ---------- end prjtargetextend ----------
Z = UnitZ(Factor=1)
pt_3 = Point(gridgenerator_2)
clean = CleanTree(RemoveNulls=True, RemoveInvalid=True, RemoveEmpty=False, Tree=pt_3)
flatten = FlattenTree(Tree=clean, Path="{0}")
project = ProjectPoint(Point=clean, Direction=Z, Geometry=prjtargetextend.a)  # -> Point, Index

c_script = CSharpScript(x=gridgenerator)  # -> out, a; inputs x: tree
# ---------- c_script: C# ----------
// Grasshopper Script Instance
#region Usings
using System;
using System.Linq;
using System.Collections;
using System.Collections.Generic;
using System.Drawing;

using Rhino;
using Rhino.Geometry;

using Grasshopper;
using Grasshopper.Kernel;
using Grasshopper.Kernel.Data;
using Grasshopper.Kernel.Types;
#endregion

public class Script_Instance : GH_ScriptInstance
{
    #region Notes
    /* 
      Members:
        RhinoDoc RhinoDocument
        GH_Document GrasshopperDocument
        IGH_Component Component
        int Iteration

      Methods (Virtual & overridable):
        Print(string text)
        Print(string format, params object[] args)
        Reflect(object obj)
        Reflect(object obj, string method_name)
    */
    #endregion

    private void RunScript(DataTree<object> x, object y, ref object a)
    {
        // Write your logic here
        DataTree<string> paths= new();
        foreach (var path in x.Paths){
            string itemPath = string.Join(":", path.Indices);
            int i = 0;
            foreach (var item in x.Branch(path)){
                paths.Add($"{itemPath}:{i}",path);
                i++;
            }
        }
        a = paths;
    }
}
# ---------- end c_script ----------
concat = Concatenate(FragmentA=Slider(0, range=0..1), FragmentB=Slider(0, range=0..4), JoinSeparator=";")
rev = ReverseList(List=c_script.a)
branch = TreeBranch(Tree=gridgenerator, Path=concat, MaintainPaths=True)
item = ListItem(List=branch, Index=Slider(0, range=0..3), Wrap=True)
textdot = DefineTextDot(Text=rev, Location=project.Point, Font="Arial", Size=Slider(18, range=0..100))
preview = CustomPreview(Geometry=textdot, Material=ColourSwatch(SwatchColor=RGB(255, 255, 255)))

flatten_2 = FlattenTree(Tree=project.Point, Path="{0}")
pdecon = Deconstruct(Point=flatten_2)  # -> XComponent, YComponent, ZComponent
item_2 = ListItem(List=flatten, Index=0, Wrap=True)
sort = SortList(Keys=pdecon.ZComponent, ValuesA=pdecon.ZComponent)  # -> Keys, ValuesA
pdecon_2 = Deconstruct(Point=item_2)  # -> XComponent, YComponent, ZComponent
item_3 = ListItem(List=sort.ValuesA, Index=0, Wrap=True)
subtraction = Subtraction(A=pdecon_2.ZComponent, B=item_3)
Z_2 = UnitZ(Factor=subtraction)
move = Move(Geometry=project.Point, Motion=Z_2)  # -> Geometry, Transform
dist = Distance(PointA=clean, PointB=move.Geometry)
flatten_3 = FlattenTree(Tree=dist, Path="{0}")
Z_3 = UnitZ(Factor=dist)
move_2 = Move(Geometry=gridgenerator_2, Motion=Z_3)  # -> Geometry, Transform
sort_2 = SortList(Keys=flatten_3, ValuesA=flatten_3)  # -> Keys, ValuesA
int = Integer(dist)
merge = Merge(Data1=gridgenerator, Data2=move_2.Geometry)
item_4 = ListItem(List=sort_2.ValuesA, Index=0, Wrap=True)  # -> Item1, Item
rev_2 = ReverseList(List=int)

# ----
# controller api server url
# port base (75 -> 7501, 7512, ...)
# api endpoint route
# activate requests
# get current status
# linear actuator specs
fetch_current_value = Button()
max_lin_act_extension_mm = Slider(850, range=0..1000)
send_requests = BooleanToggle(False)

larger = LargerThan(FirstNumber=item_4.Item1, SecondNumber=max_lin_act_extension_mm)  # -> LargerThan, OrEqualTo
c_script_2 = CSharpScript(url="http://127.0.0.1", portBase="75", route="actuators", valueTree=rev_2)  # -> out, a; inputs url: String, portBase: String, valueTree: tree of Int32
# ---------- c_script_2: C# ----------
// Grasshopper Script Instance
#region Usings
using System;
using System.Linq;
using System.Collections;
using System.Collections.Generic;
using System.Drawing;

using Rhino;
using Rhino.Geometry;

using Grasshopper;
using Grasshopper.Kernel;
using Grasshopper.Kernel.Data;
using Grasshopper.Kernel.Types;
#endregion

public class Script_Instance : GH_ScriptInstance
{
    #region Notes
    /* 
      Members:
        RhinoDoc RhinoDocument
        GH_Document GrasshopperDocument
        IGH_Component Component
        int Iteration

      Methods (Virtual & overridable):
        Print(string text)
        Print(string format, params object[] args)
        Reflect(object obj)
        Reflect(object obj, string method_name)
    */
    #endregion

    private void RunScript(
		string url,
		string portBase,
		object route,
		DataTree<int> valueTree,
		object y,
		ref object a)
    {
        // Write your logic here
        DataTree<string> urls = new();

        foreach (var item in valueTree.Paths){
            string path = string.Join("",item.Indices);
            string endpoint = $"{url}:{portBase}{path}/{route}";
            urls.Add(endpoint,new GH_Path(item));
        }


        a = urls;

    }
}
# ---------- end c_script_2 ----------
not = GateNot(A=larger.LargerThan)
filter = StreamFilter(
    Gate=larger.LargerThan,
    Stream0=ColourSwatch(SwatchColor=RGB(84, 84, 84)),
    Stream1=ColourSwatch(SwatchColor=RGB(255, 0, 0)))
and = GateAnd(A=not, B=send_requests)
move_3 = Move(Geometry=srf, Motion=Z_2)  # -> Geometry, Transform
preview_2 = CustomPreview(Geometry=merge, Material=filter)
c_script_3 = CSharpScript(url=c_script_2.a, valueTree=rev_2, submit=and)  # -> out, a, b, c; inputs url: tree of String, valueTree: tree of Int32, submit: Boolean
# ---------- c_script_3: C# ----------
// Grasshopper Script Instance
#region Usings
using System;
using System.Collections.Generic;
using System.Net.Http;
using System.Text;
using System.Text.Json;
using Grasshopper.Kernel.Data;
using Grasshopper;
#endregion

public class Script_Instance : GH_ScriptInstance
{
    private static readonly HttpClient HttpClient = new HttpClient
    {
        Timeout = TimeSpan.FromSeconds(15)
    };

    private void RunScript(
		DataTree<string> url,
		DataTree<int> valueTree,
		bool submit,
		ref object a,
		ref object b,
		ref object c)
    {
        var statusCodes = new DataTree<int>();
        var responses = new DataTree<string>();

        if (!submit)
        {
            a = "Idle (set submit=true to send)";
            b = statusCodes;
            c = responses;
            return;
        }


        if (valueTree is null || valueTree.BranchCount == 0)
        {
            a = "Error";
            b = statusCodes;
            responses.Add("valueTree must contain at least one branch.", new GH_Path(0));
            c = responses;
            return;
        }

        int successCount = 0;

        try
        {
            foreach (GH_Path path in valueTree.Paths)
            {
                List<int> branch = valueTree.Branch(path);
                if (branch is null || branch.Count < 4)
                {
                    statusCodes.Add(-1, path);
                    responses.Add("Branch must contain at least 4 target values.", path);
                    continue;
                }

                var body = new
                {
                    a1_target = branch[0],
                    a2_target = branch[1],
                    a3_target = branch[2],
                    a4_target = branch[3],
                };
                var endpoint = url.Branch(path)[0];

                        if (string.IsNullOrWhiteSpace(endpoint))
                        {
                            a = "Error";
                            b = statusCodes;
                            responses.Add("URL input is required.", new GH_Path(0));
                            c = responses;
                            return;
                        }

                string requestBody = JsonSerializer.Serialize(body);
                var result = PostTargets(endpoint, requestBody);

                statusCodes.Add(result.statusCode, path);
                responses.Add(FormatJsonPretty(result.responseBody), path);
                successCount++;
            }

            a = successCount > 0 ? "Sent" : "No valid branches";
            b = statusCodes;
            c = responses;
        }
        catch (Exception ex)
        {
            a = "Error";
            b = statusCodes;
            responses.Add(ex.Message, new GH_Path(0));
            c = responses;
        }
    }

    private static (int statusCode, string responseBody) PostTargets(
        string url,
        string requestBody
    )
    {
        using var content = new StringContent(requestBody, Encoding.UTF8, "application/json");
        using HttpResponseMessage response = HttpClient.PostAsync(url, content).Result;
        string responseBody = response.Content.ReadAsStringAsync().Result;
        return ((int)response.StatusCode, responseBody);
    }

    private static string FormatJsonPretty(string json)
{
    if (string.IsNullOrWhiteSpace(json))
    {
        return json ?? string.Empty;
    }
    try
    {
        using JsonDocument doc = JsonDocument.Parse(json);
        return JsonSerializer.Serialize(doc.RootElement, new JsonSerializerOptions
        {
            WriteIndented = true
        });
    }
    catch
    {
        // If response is not valid JSON, return original text
        return json;
    }
}
}
# ---------- end c_script_3 ----------
c_script_4 = CSharpScript(url=c_script_2.a, run=fetch_current_value, submit=send_requests)  # -> out, a, b, c; inputs url: tree of String, submit: Boolean
# ---------- c_script_4: C# ----------
// Grasshopper Script Instance
#region Usings
using System;
using System.Collections.Generic;
using System.Net.Http;
using System.Text.Json;
using Grasshopper.Kernel.Data;
using Grasshopper;
#endregion

public class Script_Instance : GH_ScriptInstance
{
    private static readonly HttpClient HttpClient = new HttpClient
    {
        Timeout = TimeSpan.FromSeconds(15)
    };

    private void RunScript(
		DataTree<string> url,
		object run,
		bool submit,
		ref object a,
		ref object b,
		ref object c)
    {
        var statusCodes = new DataTree<int>();
        var responses = new DataTree<string>();

        if (!submit)
        {
            a = "Idle (set submit=true to send)";
            b = statusCodes;
            c = responses;
            return;
        }

        if (url is null || url.BranchCount == 0)
        {
            a = "Error";
            b = statusCodes;
            responses.Add("url tree must contain at least one branch.", new GH_Path(0));
            c = responses;
            return;
        }

        int successCount = 0;

        try
        {
            foreach (GH_Path path in url.Paths)
            {
                List<string> branch = url.Branch(path);
                if (branch is null || branch.Count == 0 || string.IsNullOrWhiteSpace(branch[0]))
                {
                    statusCodes.Add(-1, path);
                    responses.Add("Branch must contain a non-empty URL.", path);
                    continue;
                }

                string endpoint = branch[0];
                var result = GetActuators(endpoint);

                statusCodes.Add(result.statusCode, path);
                responses.Add(FormatJsonPretty(result.responseBody), path);
                successCount++;
            }

            a = successCount > 0 ? "Sent" : "No valid branches";
            b = statusCodes;
            c = responses;
        }
        catch (Exception ex)
        {
            a = "Error";
            b = statusCodes;
            responses.Add(ex.Message, new GH_Path(0));
            c = responses;
        }
    }

    private static (int statusCode, string responseBody) GetActuators(string url)
    {
        using HttpResponseMessage response = HttpClient.GetAsync(url).Result;
        string responseBody = response.Content.ReadAsStringAsync().Result;
        return ((int)response.StatusCode, responseBody);
    }

    private static string FormatJsonPretty(string json)
    {
        if (string.IsNullOrWhiteSpace(json))
        {
            return json ?? string.Empty;
        }

        try
        {
            using JsonDocument doc = JsonDocument.Parse(json);
            return JsonSerializer.Serialize(doc.RootElement, new JsonSerializerOptions
            {
                WriteIndented = true
            });
        }
        catch
        {
            return json;
        }
    }
}
# ---------- end c_script_4 ----------

panel = Panel(c_script_4.c)
panel_2 = Panel(c_script_3.c)

# ==== cluster GridGenerator
object = ClusterInput()
relay = ClusterInput()
N = ClusterInput()
N_2 = ClusterInput()
F = ClusterInput()
A = ClusterInput()
Y = UnitY(Factor=F)
X = UnitX(Factor=F)
multiplication = Multiplication(A=A, B=Y)
vec = Vector(relay)
object_2 = ModelObject(object)
move = Move(Geometry=object_2, Motion=vec)  # -> Geometry, Transform
arrlinear = LinearArray(Geometry=relay, Direction=X, Count=N)  # -> Geometry, Transform
arrlinear_2 = LinearArray(Geometry=relay, Direction=Y, Count=N_2)  # -> Geometry, Transform
move_2 = Move(Geometry=move.Geometry, Motion=multiplication)  # -> Geometry, Transform
merge = Merge(Data1=move.Geometry, Data2=move_2.Geometry)
graft = GraftTree(Tree=merge, IncludeEmptyLists=True, IncludeNullItems=True)
transform = Transform(Geometry=graft, Transform=arrlinear.Transform)
graft_2 = GraftTree(Tree=transform, IncludeEmptyLists=True, IncludeNullItems=True)
transform_2 = Transform(Geometry=graft_2, Transform=arrlinear_2.Transform)
simplify = SimplifyTree(Tree=transform_2, Front=False)
T = ClusterOutput(simplify)
