# Grasshopper definition gh_client.gh (Grasshopper 1.0.8)

block_definition = ModelBlockDefinition(<model block definition referenced from the Rhino model>)
number_slider = Slider(5, range=0..10)
number_slider_2 = Slider(4, range=0..10)
number_slider_3 = Slider(450, range=0..1000)
number_slider_4 = Slider(4, range=0..10)
block_definition_2 = ModelBlockDefinition(<model block definition referenced from the Rhino model>)
pt = Point(<point referenced from the Rhino model>)
srf = Surface(<surface referenced from the Rhino model>)
pt_2 = Point(Point(192.0000015, 144.1598235, 60.66119645))
gridgenerator = GridGenerator(object=block_definition, relay=pt_2, N=number_slider, N_2=number_slider_2, F=number_slider_3, A=number_slider_4)
gridgenerator_2 = GridGenerator(object=block_definition_2, relay=pt, N=number_slider, N_2=number_slider_2, F=number_slider_3, A=number_slider_4)
prjtargetextend = CSharpScript(x=srf)  # -> out, a; inputs x: Surface
# ---------- prjtargetextend: C# ----------
// Grasshopper Script Instance
#region Usings
using System;
using System.Linq;
using System.Collections;
using System.Collections.Generic;
using System.Drawing;

using Rhino;
using Rhino.Geometry;

using Grasshopper;
using Grasshopper.Kernel;
using Grasshopper.Kernel.Data;
using Grasshopper.Kernel.Types;
#endregion

public class Script_Instance : GH_ScriptInstance
{
    #region Notes
    /* 
      Members:
        RhinoDoc RhinoDocument
        GH_Document GrasshopperDocument
        IGH_Component Component
        int Iteration

      Methods (Virtual & overridable):
        Print(string text)
        Print(string format, params object[] args)
        Reflect(object obj)
        Reflect(object obj, string method_name)
    */
    #endregion

    private void RunScript(Surface x, ref object a)
    {
        // Write your logic here
        var srv01 = x.Extend(IsoStatus.East,100,true).Extend(IsoStatus.West,100,true);
        var srv02 = srv01.Extend(IsoStatus.North,100,true).Extend(IsoStatus.South,100,true);
        a = srv02;
    }
}
# ---------- end prjtargetextend ----------
Z = UnitZ(Factor=1)
pt_3 = Point(gridgenerator_2)
clean = CleanTree(RemoveNulls=True, RemoveInvalid=True, RemoveEmpty=False, Tree=pt_3)
flatten = FlattenTree(Tree=clean, Path="{0}")
project = ProjectPoint(Point=clean, Direction=Z, Geometry=prjtargetextend.a)  # -> Point, Index
flatten_2 = FlattenTree(Tree=project.Point, Path="{0}")
pdecon = Deconstruct(Point=flatten_2)  # -> XComponent, YComponent, ZComponent
item = ListItem(List=flatten, Index=0, Wrap=True)
sort = SortList(Keys=pdecon.ZComponent, ValuesA=pdecon.ZComponent)  # -> Keys, ValuesA
pdecon_2 = Deconstruct(Point=item)  # -> XComponent, YComponent, ZComponent
item_2 = ListItem(List=sort.ValuesA, Index=0, Wrap=True)
concat = Concatenate(FragmentA=Slider(0, range=0..3), FragmentB=Slider(4, range=0..4), JoinSeparator=";")
subtraction = Subtraction(A=pdecon_2.ZComponent, B=item_2)
branch = TreeBranch(Tree=clean, Path=concat, MaintainPaths=True)
Z_2 = UnitZ(Factor=subtraction)
item_3 = ListItem(List=branch, Index=Slider(0, range=0..3), Wrap=True)
move = Move(Geometry=project.Point, Motion=Z_2)  # -> Geometry, Transform
dist = Distance(PointA=clean, PointB=move.Geometry)
flatten_3 = FlattenTree(Tree=dist, Path="{0}")
Z_3 = UnitZ(Factor=dist)
move_2 = Move(Geometry=gridgenerator_2, Motion=Z_3)  # -> Geometry, Transform
sort_2 = SortList(Keys=flatten_3, ValuesA=flatten_3)  # -> Keys, ValuesA
merge = Merge(Data1=gridgenerator, Data2=move_2.Geometry)
item_4 = ListItem(List=sort_2.ValuesA, Index=0, Wrap=True)  # -> Item1, Item
int = Integer(dist)
c_script = CSharpScript(url="http://127.0.0.1", portBase="75", route="actuators", valueTree=int)  # -> out, a; inputs url: String, portBase: String, valueTree: tree of Int32
# ---------- c_script: C# ----------
// Grasshopper Script Instance
#region Usings
using System;
using System.Linq;
using System.Collections;
using System.Collections.Generic;
using System.Drawing;

using Rhino;
using Rhino.Geometry;

using Grasshopper;
using Grasshopper.Kernel;
using Grasshopper.Kernel.Data;
using Grasshopper.Kernel.Types;
#endregion

public class Script_Instance : GH_ScriptInstance
{
    #region Notes
    /* 
      Members:
        RhinoDoc RhinoDocument
        GH_Document GrasshopperDocument
        IGH_Component Component
        int Iteration

      Methods (Virtual & overridable):
        Print(string text)
        Print(string format, params object[] args)
        Reflect(object obj)
        Reflect(object obj, string method_name)
    */
    #endregion

    private void RunScript(
		string url,
		string portBase,
		object route,
		DataTree<int> valueTree,
		object y,
		ref object a)
    {
        // Write your logic here
        DataTree<string> urls = new();

        foreach (var item in valueTree.Paths){
            string path = string.Join("",item.Indices);
            string endpoint = $"{url}:{portBase}{path}/{route}";
            urls.Add(endpoint,new GH_Path(item));
        }


        a = urls;

    }
}
# ---------- end c_script ----------
larger = LargerThan(FirstNumber=item_4.Item1, SecondNumber=Slider(850, range=0..1000))  # -> LargerThan, OrEqualTo
filter = StreamFilter(
    Gate=larger.LargerThan,
    Stream0=ColourSwatch(SwatchColor=RGB(84, 84, 84)),
    Stream1=ColourSwatch(SwatchColor=RGB(255, 0, 0)))
c_script_2 = CSharpScript(url=c_script.a, submit=Toggle(True))  # -> out, a, b, c; inputs url: String, targets: list of Int32, submit: Boolean
# ---------- c_script_2: C# ----------
// Grasshopper Script Instance
#region Usings
using System;
using System.Collections.Generic;
using System.Net.Http;
using System.Text;
using System.Text.Json;
using System.Threading.Tasks;
#endregion

public class Script_Instance : GH_ScriptInstance
{
    private void RunScript(
		string url,
		List<int> targets,
		bool submit,
		ref object a,
		ref object b,
		ref object c)
    {
        if (!submit)
        {
            a = "Idle (set submit=true to send)";
            b = null;
            c = null;
            return;
        }

        if (string.IsNullOrWhiteSpace(url))
        {
            a = "Error";
            b = null;
            c = "URL input is required.";
            return;
        }

        if (targets is null || targets.Count < 4)
        {
            a = "Error";
            b = null;
            c = "Targets must contain at least 4 values: a1..a4.";
            return;
        }

        try
        {
            var body = new
            {
                a1_target = targets[0],
                a2_target = targets[1],
                a3_target = targets[2],
                a4_target = targets[3],
            };

            string requestBody = JsonSerializer.Serialize(body);
            var result = PostTargetsAsync(url, requestBody).GetAwaiter().GetResult();
            a = "Sent";
            b = result.statusCode;
            c = result.responseBody;
        }
        catch (Exception ex)
        {
            a = "Error";
            b = null;
            c = ex.Message;
        }
    }

    private static async Task<(int statusCode, string responseBody)> PostTargetsAsync(
        string url,
        string requestBody
    )
    {
        using var httpClient = new HttpClient { Timeout = TimeSpan.FromSeconds(15) };
        using var content = new StringContent(requestBody, Encoding.UTF8, "application/json");
        using HttpResponseMessage response = await httpClient.PostAsync(url, content);
        string responseBody = await response.Content.ReadAsStringAsync();
        return ((int)response.StatusCode, responseBody);
    }
}
# ---------- end c_script_2 ----------
preview = CustomPreview(Geometry=merge, Material=filter)
panel = Panel(int)

# ==== cluster GridGenerator
object = ClusterInput()
relay = ClusterInput()
N = ClusterInput()
N_2 = ClusterInput()
F = ClusterInput()
A = ClusterInput()
Y = UnitY(Factor=F)
X = UnitX(Factor=F)
multiplication = Multiplication(A=A, B=Y)
vec = Vector(relay)
object_2 = ModelObject(object)
move = Move(Geometry=object_2, Motion=vec)  # -> Geometry, Transform
arrlinear = LinearArray(Geometry=relay, Direction=X, Count=N)  # -> Geometry, Transform
arrlinear_2 = LinearArray(Geometry=relay, Direction=Y, Count=N_2)  # -> Geometry, Transform
move_2 = Move(Geometry=move.Geometry, Motion=multiplication)  # -> Geometry, Transform
merge = Merge(Data1=move.Geometry, Data2=move_2.Geometry)
graft = GraftTree(Tree=merge, IncludeEmptyLists=True, IncludeNullItems=True)
transform = Transform(Geometry=graft, Transform=arrlinear.Transform)
graft_2 = GraftTree(Tree=transform, IncludeEmptyLists=True, IncludeNullItems=True)
transform_2 = Transform(Geometry=graft_2, Transform=arrlinear_2.Transform)
simplify = SimplifyTree(Tree=transform_2, Front=False)
T = ClusterOutput(simplify)
