# Grasshopper definition linear_actuator_client_plugin.ghx (Grasshopper 1.0.8)
# plug-ins: Dynamic Formwork GhClient, eleFront

block_definition = ModelBlockDefinition(<model block definition referenced from the Rhino model>)
number_slider = Slider(5, range=0..10)
number_slider_2 = Slider(4, range=0..10)
number_slider_3 = Slider(450, range=0..1000)
number_slider_4 = Slider(4, range=0..10)
block_definition_2 = ModelBlockDefinition(<model block definition referenced from the Rhino model>)
pt = Point(<point referenced from the Rhino model>)
pt_2 = Point(Point(192.0000015, 144.1598235, 60.66119645))
gridgenerator = GridGenerator(object=block_definition, relay=pt_2, N=number_slider, N_2=number_slider_2, F=number_slider_3, A=number_slider_4)
gridgenerator_2 = GridGenerator(object=block_definition_2, relay=pt, N=number_slider, N_2=number_slider_2, F=number_slider_3, A=number_slider_4)
pt_3 = Point(gridgenerator_2)
Z = UnitZ(Factor=1)
clean = CleanTree(RemoveNulls=True, RemoveInvalid=True, RemoveEmpty=False, Tree=pt_3)
flatten = FlattenTree(Tree=clean, Path="{0}")
item = ListItem(List=flatten, Index=0, Wrap=True)
pdecon = Deconstruct(Point=item)  # -> XComponent, YComponent, ZComponent
number_slider_5 = Slider(105, range=0..1000)

srf = Surface(<surface referenced from the Rhino model>)
offset = Slider(60, range=0..100)
max_lin_act_extension_mm = Slider(850, range=0..1000)
send_targets = Button()

tsse = TwoSideSurfaceExtend(Sruface=srf, Amount=Slider(100, range=0..1000))
project = ProjectPoint(Point=clean, Direction=Z, Geometry=tsse)  # -> Point, Index

c_script = CSharpScript(x=gridgenerator)  # -> out, a; inputs x: tree
# ---------- c_script: C# ----------
// Grasshopper Script Instance
#region Usings
using System;
using System.Linq;
using System.Collections;
using System.Collections.Generic;
using System.Drawing;

using Rhino;
using Rhino.Geometry;

using Grasshopper;
using Grasshopper.Kernel;
using Grasshopper.Kernel.Data;
using Grasshopper.Kernel.Types;
#endregion

public class Script_Instance : GH_ScriptInstance
{
    #region Notes
    /* 
      Members:
        RhinoDoc RhinoDocument
        GH_Document GrasshopperDocument
        IGH_Component Component
        int Iteration

      Methods (Virtual & overridable):
        Print(string text)
        Print(string format, params object[] args)
        Reflect(object obj)
        Reflect(object obj, string method_name)
    */
    #endregion

    private void RunScript(DataTree<object> x, object y, ref object a)
    {
        // Write your logic here
        DataTree<string> paths= new();
        foreach (var path in x.Paths){
            string itemPath = string.Join(":", path.Indices);
            int i = 0;
            foreach (var item in x.Branch(path)){
                paths.Add($"{itemPath}:{i}",path);
                i++;
            }
        }
        a = paths;
    }
}
# ---------- end c_script ----------
concat = Concatenate(FragmentA=Slider(0, range=0..1), FragmentB=Slider(0, range=0..4), JoinSeparator=";")
rev = ReverseList(List=c_script.a)
branch = TreeBranch(Tree=gridgenerator, Path=concat, MaintainPaths=True)
item_2 = ListItem(List=branch, Index=Slider(0, range=0..3), Wrap=True)
textdot = DefineTextDot(Text=rev, Location=project.Point, Font="Arial", Size=Slider(18, range=0..100))
preview = CustomPreview(Geometry=textdot, Material=ColourSwatch(SwatchColor=RGB(255, 255, 255)))

flatten_2 = FlattenTree(Tree=project.Point, Path="{0}")
pdecon_2 = Deconstruct(Point=flatten_2)  # -> XComponent, YComponent, ZComponent
sort = SortList(Keys=pdecon_2.ZComponent, ValuesA=pdecon_2.ZComponent)  # -> Keys, ValuesA
item_3 = ListItem(List=sort.ValuesA, Index=0, Wrap=True)
subtraction = Subtraction(A=pdecon.ZComponent, B=item_3)
Z_2 = UnitZ(Factor=subtraction)
move = Move(Geometry=project.Point, Motion=Z_2)  # -> Geometry, Transform
dist = Distance(PointA=clean, PointB=move.Geometry)
flatten_3 = FlattenTree(Tree=dist, Path="{0}")
move_2 = Move(Geometry=srf, Motion=Z_2)  # -> Geometry, Transform
Z_3 = UnitZ(Factor=dist)
int = Integer(dist)
move_3 = Move(Geometry=gridgenerator_2, Motion=Z_3)  # -> Geometry, Transform
sort_2 = SortList(Keys=flatten_3, ValuesA=flatten_3)  # -> Keys, ValuesA

addition = Addition(A=int, B=offset)
rev_2 = ReverseList(List=addition)
mc = MotionClient(URL="http://127.0.0.1:7500", Targets=rev_2, SendTargets=send_targets, GetCurrent=Toggle(True))  # -> CurrentState, OutgoingBundle

merge = Merge(Data1=gridgenerator, Data2=move_3.Geometry)
item_4 = ListItem(List=sort_2.ValuesA, Index=0, Wrap=True)  # -> Item1, Item
larger = LargerThan(FirstNumber=item_4.Item1, SecondNumber=max_lin_act_extension_mm)  # -> LargerThan, OrEqualTo
filter = StreamFilter(
    Gate=larger.LargerThan,
    Stream0=ColourSwatch(SwatchColor=RGBA(84, 84, 84, 180)),
    Stream1=ColourSwatch(SwatchColor=RGBA(255, 0, 0, 180)))
filter_2 = StreamFilter(
    Gate=larger.LargerThan,
    Stream0=ColourSwatch(SwatchColor=RGB(84, 84, 84)),
    Stream1=ColourSwatch(SwatchColor=RGB(255, 0, 0)))
preview_2 = CustomPreview(Geometry=move_2.Geometry, Material=filter)
preview_3 = CustomPreview(Geometry=merge, Material=filter_2)

panel = Panel(rev_2)
panel_2 = Panel(mc.CurrentState)

# ==== cluster GridGenerator
object = ClusterInput()
relay = ClusterInput()
N = ClusterInput()
N_2 = ClusterInput()
F = ClusterInput()
A = ClusterInput()
Y = UnitY(Factor=F)
X = UnitX(Factor=F)
multiplication = Multiplication(A=A, B=Y)
vec = Vector(relay)
object_2 = ModelObject(object)
move = Move(Geometry=object_2, Motion=vec)  # -> Geometry, Transform
arrlinear = LinearArray(Geometry=relay, Direction=X, Count=N)  # -> Geometry, Transform
arrlinear_2 = LinearArray(Geometry=relay, Direction=Y, Count=N_2)  # -> Geometry, Transform
move_2 = Move(Geometry=move.Geometry, Motion=multiplication)  # -> Geometry, Transform
merge = Merge(Data1=move.Geometry, Data2=move_2.Geometry)
graft = GraftTree(Tree=merge, IncludeEmptyLists=True, IncludeNullItems=True)
transform = Transform(Geometry=graft, Transform=arrlinear.Transform)
graft_2 = GraftTree(Tree=transform, IncludeEmptyLists=True, IncludeNullItems=True)
transform_2 = Transform(Geometry=graft_2, Transform=arrlinear_2.Transform)
simplify = SimplifyTree(Tree=transform_2, Front=False)
T = ClusterOutput(simplify)
