# Grasshopper definition 250329_板厚分布評価_パラメータ最適化 (1).gh (Grasshopper 1.0.8)
# Copyright: © 2017-2022 Pierre Cuvilliers, Caitlin Mueller, Massachusetts Institute of Technology
# plug-ins: LunchBox

number_slider = Slider(300, range=0..1000)

# ---- group: ghpython remote : rhino8であれば不要かもしれません
panel = Panel("""numpy
collections""")
pythonremote = GHPythonRemote(location="C:\Users\simon\anaconda3\envs\rhinoremote", run=Toggle(True), modules=panel)  # -> out, linked_modules, rpy, import_statements

# ----
Z = UnitZ(Factor=1)

# ---- group: 型枠 / リブ高さ
number_slider_2 = Slider(25, range=0..500)

# ---- group: 吐出角度
number_slider_3 = Slider(25, range=0..90)

# ---- group: メッシュ分割数（X軸方向）
number_slider_4 = Slider(120, range=0..1000)

# ---- group: ガウス分布の標準偏差
number_slider_5 = Slider(49.09, range=0..1000)

# ---- group: メッシュ分割数（Y軸方向）
number_slider_6 = Slider(60, range=0..1000)

# ----
# Input
toggle = BooleanToggle(True)
path = FilePath("C:\Users\hiroki-awaji\Downloads\data.xlsx")
neg = Negative(Value=Z)
path_2 = FilePath("C:\Users\hiroki-awaji\Downloads\data.xlsx")
cluster = Cluster(
    R_2=Slider(100, range=0..100),
    F_2=Slider(100, range=0..100),
    R=Slider(30, range=0..100),
    F=Slider(300, range=0..1000),
    F_3=Slider(200, range=0..1000),
    i=Slider(2, range=0..10),
    L=Slider(300, range=0..1000),
    R_5=Slider(20, range=0..100),
    R_4=Slider(80, range=0..100),
    R_3=Slider(35, range=0..100),
    L_2=number_slider,
    F_4=Slider(150, range=0..1000))

# ---- group: 型枠 / 型枠サーフェス（リブなし）
srf = Surface(<surface referenced from the Rhino model>)

# ----
excelread = ExcelReader(ReadExcelData=Toggle(True), WorkbookPath=path, WorksheetName="A_1")  # -> Exceptions, ExcelData
excelread_2 = ExcelReader(ReadExcelData=toggle, WorkbookPath=path_2, WorksheetName="A_1")  # -> Exceptions, ExcelData

# ---- group: 型枠
debrep = DeconstructBrep(Brep=srf)  # -> Faces, Edges, Vertices
Z_2 = UnitZ(Factor=number_slider_2)
extr = Extrude(Base=debrep.Edges, Direction=Z_2)
preview = CustomPreview(Geometry=extr, Material=ColourSwatch(SwatchColor=RGB(135, 135, 135)))

# ----
# 半円断面型枠生成
Z_3 = UnitZ(Factor=number_slider)
cluster_2 = Cluster_2()  # -> B, srf_2, E
division = Division(A=number_slider_6, B=3)
num = Number(number_slider_3)

# ----
# Spray Parameters
d_mm = Slider(416, range=300..500)
q_mm_s = Slider(170, range=100..300)
α_mm = Slider(45, range=0..90)
β_mm = Slider(25, range=0..90)

move = Move(Geometry=cluster, Motion=Z_3)  # -> Geometry, Transform
cluster_3 = Cluster_16(L=excelread.ExcelData)  # -> index, time, step, iphone, direction

# ----
# Formwork Surface
srf_2 = Surface(<surface referenced from the Rhino model>)

panel_2 = Panel(excelread_2.ExcelData)
X = UnitX(Factor=1)
panel_3 = Panel(number_slider_6)
panel_4 = Panel(number_slider_4)
panel_5 = Panel(division)

# ----
# 吹付ガン形状
brep = Brep(move.Geometry)

# ---- group: リブあり
brep_2 = Brep(cluster_2.B)

# ---- group: リブ
srf_3 = Surface(cluster_2.srf_2)

# ----
pt = Point(cluster_3.iphone)
srf_4 = Surface(srf_2)
num_2 = Number(number_slider_6)
rad = Radians(Degrees=β_mm)
num_3 = Number(number_slider_4)
pline = PolyLine(Vertices=pt, Closed=False)
eval = Evaluate(F="2*d*tan(b)", d=d_mm, b=rad)
division_2 = Division(A=eval, B=2)
shift = ShiftList(List=cluster_3.step, Shift=1, Wrap=Toggle(False))
cluster_4 = Cluster_14(srf=srf_3, S=srf_2, x=d_mm, L=q_mm_s, num_2=division_2, num_3=eval, num_4=division_2, num=α_mm)  # -> crv_4, P_3, C_3, C, C_2, P_2, P, i_2, i
subtraction = Subtraction(A=shift, B=cluster_3.step)
multiplication = Multiplication(A=panel_4, B=panel_3)
division_3 = Division(A="20", B=2)
panel_6 = Panel("0")
merge = Merge(Data1="0", Data2="20", Data3="40")
addition = Addition(A=division_3, B=20)
addition_2 = Addition(A=addition, B=20)

# ---- group: 型枠サーフェスを分割
divide = DivideDomain²(Domain=srf_4, UCount=num_3, VCount=num_2)
subsrf = Isotrim(Surface=srf_4, Domain=divide)

# ----
division_4 = Division(A=multiplication, B=6)
item = ListItem(List=subtraction, Index="-1", Wrap=True)
division_5 = Division(A=multiplication, B=panel_3)

# ---- group: 1sごとの吹付ガンの位置（V方向）
pt_2 = Point(graft(cluster_4.P))

# ---- group: 1sごとの吹付ガンの位置（U方向）
pt_3 = Point(graft(cluster_4.P_2))

# ---- group: 吹付軌道（V方向）
crv = Curve(cluster_4.C_2)

# ---- group: 1sごとの吹付ガンのベクトル（V方向）
vec = Vector(cluster_4.i)

# ---- group: 1sごとの吹付ガンの位置（リブ部）
pt_4 = Point(graft(cluster_4.P_3))

# ---- group: 吹付軌道（U方向）
crv_2 = Curve(cluster_4.crv_4)

# ---- group: 1sごとの吹付ガンのベクトル（リブ部）
vec_2 = Vector(cluster_4.C_3)

# ----
merge_2 = Merge(Data1=division_3, Data2=addition, Data3=addition_2)

# ---- group: 1sごとの吹付ガンのベクトル（U方向）
vec_3 = Vector(cluster_4.i_2)

# ---- group: 吹付軌道（U方向）
crv_3 = Curve(cluster_4.C)

# ----
division_6 = Division(A=division_4, B=2)
cull_i = CullIndex(List=subtraction, Indices="-1", Wrap=True)  # -> flatten(List)
series = Series(Start=merge, Step=division_4, Count="6")
division_7 = Division(A=division_5, B=6)
addition_3 = Addition(A=item, B="0.1")  # -> flatten(Result)
index = ItemIndex(List=subsrf, Item=subsrf)
partition = PartitionList(List=index, Size="60")  # -> simplify(Chunks)
addition_4 = Addition(A=merge_2, B=division_6)
flip = FlipMatrix(Data=series)  # -> flatten(Data)
series_2 = Series(Start=flip, Step=1, Count=panel_5)
series_3 = Series(Start=addition_4, Step=division_4, Count="6")
series_4 = Series(Start=series_2, Step=panel_3, Count=division_7)  # -> simplify(Series)
merge_3 = Merge(Data1=cull_i, Data2=addition_3)
partition_2 = PartitionList(List=partition, Size="20")  # -> simplify(Chunks)
flip_2 = FlipMatrix(Data=series_3)  # -> flatten(Data)

number_slider_7 = Slider(100, range=0..100)
number_slider_8 = Slider(2, range=0..100)
swatch = ColourSwatch(SwatchColor=RGB(255, 0, 0))

# ---- group: 吹付口位置・吹付方向ベクトル
pt_5 = Point(flatten(pt))
vec_4 = Vector(flatten(cluster_3.direction))
preview_2 = CustomPreview(Geometry=pt_5, Material=ColourSwatch(SwatchColor=RGB(0, 0, 0)))
vdisex = VectorDisplayEx(Point=pt_5, Vector=vec_4, Colour=ColourSwatch(SwatchColor=RGB(0, 111, 255)), Width=2)

# ---- group: ガンの位置データ
pt_6 = Point(pt_5)

# ----
line = LineSDL(Start=pt_6, Direction=neg, Length=Slider(1500, range=0..2000))
rot3d = Rotate3D(Geometry=line, Angle=degrees(num), Center=pt_6, Axis=X)  # -> Geometry, Transform

# ---- group: 吹付方向を計算
pt_7 = Point(pt_6)
vec_5 = Vector(vec_4)
addition_5 = Addition(A=pt_7, B=vec_5)
vec2pt = Vector2Pt(PointA=pt_7, PointB=addition_5, Unitize=False)  # -> Vector, Length
line_2 = LineSDL(Start=pt_7, Direction=vec2pt.Vector, Length=Slider(1500, range=0..3000))

# ----
revsrf = Revolution(Curve=rot3d.Geometry, Axis=line, Domain=Domain(0, 6.283185307))
cap = CapHoles(Brep=revsrf)
pt_8 = Point(pt_6)
lng = ListLength(List=pt_8)
vec_6 = Vector(vec2pt.Vector)
dup = DuplicateData(Data="1", Number=lng, Order=True)
pl = ConstructPlane(Origin=pt_8, XAxis=Vector(1, 0, 0), YAxis=Vector(0, 1, 0))
neg_2 = Negative(Value=vec_6)
num_4 = Number(dup)

# ---- group: 吹付線と交差するサーフェス番号を計算
num_5 = Number(number_slider_6)
python = GhPythonScript(srf=subsrf, line=line_2, v=num_5, runIt=Toggle(True))  # -> out, flatten(a); inputs srf: list of Surface, line: list of Line, v: Int32
# ---------- python: Python ----------
__author__ = "simon"
__version__ = "2025.02.23"

import rhinoscriptsyntax as rs
import ghpythonlib.components as ghcomp
import System
import Grasshopper.Kernel.Data.GH_Path as GH_Path
import Grasshopper.DataTree as DataTree
from collections import deque


# spry_cen: 吹付中心面を格納
spry_cen = []

# dv: 9方向への移動ベクトル
dv = [0, -v-1, -1, v-1, -v, v, -v+1, 1, v+1]

def main():
    for i in range(len(srf)):
        p = ghcomp.SurfaceXLine(srf[i], line[0])['points']
        if p != None:
            spry_cen.append(i)
            break
    
    for i in range(1, len(line)):
        
        q = deque([spry_cen[i-1]])
        dist = [-1]*len(srf)
        dist[spry_cen[i-1]] = 0
        find = False
        
        while find == False:
            v = q.popleft()
            
            # 8方向を探索
            for dir in range(9):
                nv = v + dv[dir]
                
                # サーフェス外、吹付中心線と交差しない場合はスルー
                if nv < 0 or nv >= len(srf):
                    continue
                    
                # 吹付中心線と交差
                p = ghcomp.SurfaceXLine(srf[nv], line[i])['points']
                if p != None:
                    find = True
                    spry_cen.append(nv)
                    break
                    
                # 探索済みの場合もスルー
                if dist[nv] != -1:
                    continue
                    
                dist[nv] = dist[v] + 1
                q.append(nv)
        
    

if runIt:
    main()
    a = spry_cen
# ---------- end python ----------

# ----
# Output
division_8 = Division(A=num_4, B="0.02")
padjust = AdjustPlane(Plane=pl, Normal=neg_2)
trim = TrimTree(Tree=series_4, Depth=1)

# ---- group: 型枠サーフェス
srf_5 = Surface(subsrf)
preview_3 = CustomPreview(Geometry=srf_5, Material=ColourSwatch(SwatchColor=RGB(255, 255, 255)))

# ----
panel_7 = Panel(merge_3)

# ---- group: 型枠サーフェス番号
data = Data(divide)
srf_6 = Surface(subsrf)
lng_2 = ListLength(List=data)
area = Area(Geometry=srf_6)  # -> Area, Centroid
Z_4 = UnitZ(Factor=Slider(10, range=0..10))
move_2 = Move(Geometry=area.Centroid, Motion=Z_4)  # -> Geometry, Transform
series_5 = Series(Start=0, Step=1, Count=lng_2)
tag = TextTag3D(
    Location=move_2.Geometry,
    Text=series_5,
    Size=Slider(8, range=0..100),
    Colour=ColourSwatch(SwatchColor=RGB(0, 0, 0)),
    Justification="5")

# ----
multiplication_2 = Multiplication(A=division_8, B="0.848")
orient = Orient(Geometry=cap, Source=pl, Target=padjust)  # -> Geometry, Transform
sort = SortList(Keys=trim, ValuesA=trim)  # -> Keys, ValuesA
panel_8 = Panel(pt_5)
cluster_5 = Cluster_15(G=brep, O=pt_3, X=vec_3, i=Slider(19, range=0..300))
multiplication_3 = Multiplication(A=vec_3, B=number_slider_7)
multiplication_4 = Multiplication(A=vec, B=number_slider_7)
multiplication_5 = Multiplication(A=vec_2, B=number_slider_7)
num_6 = Number(number_slider_5)

# ---- group: 積層高さを計算
area_2 = Area(Geometry=subsrf)  # -> Area, Centroid
num_7 = Number(number_slider_6)
num_8 = Number(number_slider_4)
brep_3 = Brep(orient.Geometry)
num_9 = Number(multiplication_2)
python_2 = GhPythonScript(discharge=num_9, sd=num_6, cone=brep_3, u=num_8, v=num_7, srf_cen=area_2.Centroid, start=python.a, runIt=Toggle(True))  # -> out, flatten(a); inputs discharge: list, cone: list of Brep, u: Int32, v: Int32, srf_cen: list of Point3d, start: list of Int32
# ---------- python_2: Python ----------
__author__ = "simon"
__version__ = "2025.02.23"

import rhinoscriptsyntax as rs
import rhinoscriptsyntax as rs
import ghpythonlib.components as ghcomp
import System
import Grasshopper.Kernel.Data.GH_Path as GH_Path
import Grasshopper.DataTree as DataTree
import math
from collections import deque

# info: 各サーフェスの積層状態を格納
## seen: 探索回数
## height: 積層高さ
info = {'seen': [], 'height':[]}

# dv: 8方向への移動ベクトル
dv = [-v-1, -1, v-1, -v, v, -v+1, 1, v+1]

# height: 各サーフェスの積層高さ
height = [0]*len(srf_cen)

def cal_height(dx, dy, dz, sigma, A):
    exponent = -(dx**2 + dy**2 + dz**2) / (2*(sigma**2))
    return A * math.exp(exponent)

def main():
    
    for i in range(len(cone)):
        
        q = deque([start[i]])
        dist = [-1]*len(srf_cen)
        dist[start[i]] = 0
        height[start[i]] = cal_height(0, 0, 0, sd, discharge[i])
        
        while q:
            v = q.popleft()
            
            # 8方向を探索
            for dir in range(8):
                nv = v + dv[dir]
                
                # サーフェス外、吹付エリア外である場合はスルー
                if nv < 0 or nv >= len(srf_cen):
                    continue
                    
                flag = ghcomp.PointInBrep(cone[i], srf_cen[nv], False)
                if flag == False:
                    continue
                    
                # 探索済みの場合もスルー
                if dist[nv] != -1:
                    continue
                
                # 積層高さを計算
                xc, yc, zc = ghcomp.Deconstruct(srf_cen[start[i]])
                xs, ys, zs = ghcomp.Deconstruct(srf_cen[nv])
                
                height[nv] += cal_height(xs-xc, ys-yc, zs-zc, sd, discharge[i])
                
                dist[nv] = dist[v] + 1
                q.append(nv)

#def dfs(idx, c, s):
#    info['seen'][s] += 1
#    
#    xc, yc, zc = ghcomp.Deconstruct(srf_cen[c])
#    xs, ys, zs = ghcomp.Deconstruct(srf_cen[s])
#    
#    info['height'][s] += cal_height(xs-xc, ys-yc, zs-zc, sd, discharge[idx])
#    
#    # 8方向を探索
#    for dir in range(8):
#        nv = s + dv[dir]
#        
#        # サーフェス外、吐出エリア外である場合はスルー
#        if nv < 0 or nv >= len(srf_cen):
#            continue
#        flag = ghcomp.PointInBrep(cone[idx], srf_cen[nv], False)
#        if flag == False:
#            continue
#        
#        # 探索済みの場合もスルー
#        if info['seen'][nv] >= 1:
#            continue
#        
#        dfs(idx, c, nv)
#
#def main():
#    
#    # infoを初期化する
#    info['height'] = [0]*len(srf_cen)
#    
#    for i in range(len(cone)):
#        info['seen'] = [0]*len(srf_cen)
#        dfs(i, start[i], start[i])
    

if runIt:
    main()
    a = height
# ---------- end python_2 ----------

# ---- group: 吐出形状
brep_4 = Brep(brep_3)
preview_4 = CustomPreview(Geometry=brep_4, Material=ColourSwatch(SwatchColor=RGBA(255, 255, 255, 78)))

# ----
num_10 = Number(python_2.a)

# ---- group: 吹付ガン
brep_5 = Brep(cluster_5)

# ---- group: ガンの方向ベクトル
vdisex_2 = VectorDisplayEx(Point=pt_4, Vector=multiplication_5, Colour=swatch, Width=number_slider_8)

vdisex_3 = VectorDisplayEx(Point=pt_3, Vector=multiplication_3, Colour=swatch, Width=number_slider_8)

vdisex_4 = VectorDisplayEx(Point=pt_2, Vector=multiplication_4, Colour=swatch, Width=number_slider_8)

# ----
sph = Sphere(Base=pt_5, Radius=Slider(20, range=0..100))
panel_9 = Panel(python.a)
srf_7 = Surface(subsrf)
pt_9 = Point(<point referenced from the Rhino model>)
pt_10 = Point(<point referenced from the Rhino model>)
multiplication_6 = Multiplication(A=python_2.a, B=10)
panel_10 = Panel(pt_8)
sort_2 = SortList(Keys=python_2.a, ValuesA=python_2.a)  # -> Keys, reverse(ValuesA)
item_2 = ListItem(List=srf_7, Index=0, Wrap=True)
lng_3 = ListLength(List=srf_7)
pdecon = Deconstruct(Point=pt_10)  # -> XComponent, YComponent, ZComponent
pdecon_2 = Deconstruct(Point=pt_9)  # -> XComponent, YComponent, ZComponent
area_3 = Area(Geometry=item_2)  # -> Area, Centroid
num_11 = Number(python_2.a)
subtraction_2 = Subtraction(A=pdecon_2.ZComponent, B=pdecon.ZComponent)
multiplication_7 = Multiplication(A=area_3.Area, B=num_11)
panel_11 = Panel(subtraction_2)
multiplication_8 = Multiplication(A=area_3.Area, B=lng_3)
ma = MassAddition(Input=multiplication_7)  # -> Result, PartialResults
division_9 = Division(A=ma.Result, B=multiplication_8)
panel_12 = Panel(division_9)
area_4 = Area(Geometry=srf_2)  # -> Area, Centroid; disabled
num_12 = Number(python_2.a)  # disabled
avr = Average(Input=num_12)  # disabled
subtraction_3 = Subtraction(A=num_12, B=avr)  # disabled
area_5 = Area()  # -> Area, Centroid; disabled
sqr = Square(Value=subtraction_3)  # disabled
# 平均
panel_13 = Panel("5")  # disabled
ma_2 = MassAddition(Input=sqr)  # -> Result, PartialResults; disabled
lng_4 = ListLength(List=sqr)  # disabled
division_10 = Division(A=ma_2.Result, B=lng_4)  # disabled
sqrt = SquareRoot(Value=division_10)  # disabled
# 標準偏差
panel_14 = Panel(sqrt)  # disabled
galapagos = Galapagos(fitness=multiplication_10, gene=[d_mm, q_mm_s])

# ---- group: 各サーフェスの法線方向に押し出す
srf_8 = Surface(reparameterize(subsrf))
md_slider = MDSlider(SliderMode=0, slider_value=Point(0.5, 0.5, 0.5), x_domain=Domain(0, 1), y_domain=Domain(0, 1), z_domain=Domain(0, 1))
pt_11 = Point(area_2.Centroid)
evalsrf = EvaluateSurface(Surface=srf_8, Point=md_slider)  # -> Point, Normal, UDirection, VDirection, Frame
multiplication_9 = Multiplication(A=evalsrf.Normal, B=python_2.a)
addition_6 = Addition(A=multiplication_9, B=pt_11)
vec2pt_2 = Vector2Pt(PointA=pt_11, PointB=addition_6, Unitize=False)  # -> Vector, Length

# ----
item_3 = ListItem(List=vec2pt_2.Length, Index=sort.ValuesA, Wrap=True)
item_4 = ListItem(List=vec2pt_2.Length, Index=graft(flip_2), Wrap=True)
avr_2 = Average(Input=item_3)
panel_15 = Panel(item_4)
panel_16 = Panel(avr_2)
neg_3 = Negative(Value=vec2pt_2.Vector)

# ---- group: 各サーフェスの法線方向に押し出す (continued)
extr_2 = Extrude(Base=srf_8, Direction=neg_3)

# ----
panel_17 = Panel(vec2pt_2.Length)  # disabled
panel_18 = Panel(vec2pt_2.Vector)  # disabled
sort_3 = SortList(Keys=panel_17, ValuesA=panel_17)  # -> Keys, reverse(ValuesA); disabled
volume = Volume(Geometry=sort_3.ValuesA)  # -> Volume, Centroid; disabled

brep_6 = Brep(extr_2)

python_3 = GhPythonScript(b=brep_6, x=num_10)  # -> out, a; inputs b: list of Brep, x: list
# ---------- python_3: Python ----------
__author__ = "simon"
__version__ = "2025.02.23"

import rhinoscriptsyntax as rs
import ghpythonlib.components as ghcomp

a = []

for i in range(len(x)):
    if x[i] != 0:
        a.append(b[i])
# ---------- end python_3 ----------

preview_5 = CustomPreview(Geometry=python_3.a, Material=ColourSwatch(SwatchColor=RGB(204, 167, 141)))

volume_2 = Volume(Geometry=brep_6)  # -> Volume, Centroid; disabled
clean = CleanTree(RemoveNulls=True, RemoveInvalid=True, RemoveEmpty=True, Tree=volume_2.Volume)  # disabled
panel_19 = Panel(clean)  # disabled
ma_3 = MassAddition(Input=panel_19)  # -> Result, PartialResults; disabled
division_11 = Division(A=ma_3.Result, B=area_4.Area)  # disabled
panel_20 = Panel(division_11)  # disabled
subtraction_4 = Subtraction(A=panel_13, B=panel_20)  # disabled
abs = Absolute(Value=subtraction_4)  # disabled
multiplication_10 = Multiplication(A=abs, B=panel_14)  # disabled
panel_21 = Panel(multiplication_10)  # disabled

# ==== cluster Cluster
F = ClusterInput()
R = ClusterInput()
R_2 = ClusterInput()
Z = UnitZ(Factor=F)
cir = Circle(Plane=PlaneXY(0, 0, 0), Radius=R)
F_2 = ClusterInput()
cir_2 = Circle(Plane=PlaneXY(0, 0, 0), Radius=R_2)
Z_2 = UnitZ(Factor=F_2)
R_3 = ClusterInput()
neg = Negative(Value=Z)
extr = Extrude(Base=cir, Direction=neg)
yz = YZPlane(Origin=Point(0, 0, 0))
extr_2 = Extrude(Base=cir_2, Direction=Z_2)
cap = CapHoles(Brep=extr)
cir_3 = Circle(Plane=yz, Radius=R_3)
cap_2 = CapHoles(Brep=extr_2)
F_3 = ClusterInput()
division = Division(A=Z_2, B=2)
X = UnitX(Factor=F_3)
extr_3 = Extrude(Base=cir_3, Direction=X)
Z_3 = UnitZ(Factor=division)
cap_3 = CapHoles(Brep=extr_3)
move = Move(Geometry=cap_3, Motion=Z_3)  # -> Geometry, Transform
Z_4 = UnitZ(Factor=1)
sdiff = SolidDifference(BrepsA=move.Geometry, BrepsB=cap_2)
L = ClusterInput()
X_2 = UnitX(Factor=1)
line = LineSDL(Start="0,0,0", Direction=Z_4, Length=L)
L_2 = ClusterInput()
neg_2 = Negative(Value=X_2)
end = EndPoints(Curve=line)  # -> Start, End
line_2 = LineSDL(Start=end.End, Direction=neg_2, Length=L_2)
merge = Merge(Data1=line, Data2=line_2)
R_4 = ClusterInput()
join = JoinCurves(Curves=merge, Preserve=False)
fillet = Fillet(Curve=join, Radius=R_4)
R_5 = ClusterInput()
F_4 = ClusterInput()
pipe = Pipe(Curve=fillet, Radius=R_5, Caps=0)
X_3 = UnitX(Factor=F_4)
move_2 = Move(Geometry=pipe, Motion=X_3)  # -> Geometry, Transform
cap_4 = CapHoles(Brep=move_2.Geometry)
sdiff_2 = SolidDifference(BrepsA=cap_4, BrepsB=sdiff)
i = ClusterInput()
item = ListItem(List=sdiff_2, Index=i, Wrap=True)
merge_2 = Merge(Data1=sdiff, Data2=item, Data3=cap, Data4=cap_2)  # -> flatten(Result)
sunion = SolidUnion(Breps=merge_2)
R_6 = ClusterOutput(sunion)

# ==== cluster Cluster_2
xz = XZPlane(Origin="3000,0,0")
dom = ConstructDomain(DomainStart="pi", DomainEnd="2*pi")
arc = Arc(Plane=xz, Radius=Slider(1000, range=0..10000), Angle=dom)  # -> Arc, Length
Y = UnitY(Factor=Slider(4880, range=0..10000))
extr = Extrude(Base=arc.Arc, Direction=Y)
debrep = DeconstructBrep(Brep=extr)  # -> Faces, Edges, Vertices
item = ListItem(List=debrep.Edges, Index=0, Wrap=True)  # -> Item, Item1, Item2, Item3
E = ClusterOutput(extr)
merge = Merge(Data1=item.Item1, Data3=item.Item3)
offset = OffsetSurface(Surface=extr, Distance="-100", Retrim=True)
debrep_2 = DeconstructBrep(Brep=offset)  # -> Faces, Edges, Vertices
crv = Curve(merge)
item_2 = ListItem(List=debrep_2.Edges, Index=0, Wrap=True)  # -> Item, Item1, Item2, Item3
merge_2 = Merge(Data1=item_2.Item1, Data3=item_2.Item3)
crv_2 = Curve(merge_2)
edgesrf = EdgeSurface(CurveA=crv, CurveB=crv_2)
merge_3 = Merge(Data1=extr, Data2=edgesrf)  # -> flatten(Result)
srf = Surface(edgesrf)
join = BrepJoin(Breps=merge_3)  # -> Breps, Closed
B = ClusterOutput(join.Breps)
srf_2 = ClusterOutput(srf)

# ==== cluster Cluster_14
x = ClusterInput()
num = ClusterInput()
num_2 = ClusterInput()
num_3 = ClusterInput()
num_4 = ClusterInput()
L = ClusterInput()
srf = ClusterInput()
S = ClusterInput()
neg = Negative(Value=x)
srf_2 = Surface(srf)
num_5 = Number(num_4)
num_6 = Number(num)
cluster = Cluster_6(S=srf_2, D=neg, num=Slider(20, range=0..100))  # -> i², pt_3, S_2, I, I_2
cluster_2 = Cluster_5(S=S, D=neg, num=num_2)  # -> i², pt_3, S_2, I, I_2
pt = Point(cluster.pt_3)
subsrf = Isotrim(Surface=reparameterize(graft(cluster.S_2)), Domain=cluster.i²)
iso = IsoCurve(Surface=subsrf, UVPoint=cluster.pt_3)  # -> UIsocurve, VIsocurve
subsrf_2 = Isotrim(Surface=reparameterize(cluster_2.S_2), Domain=cluster_2.i²)
crv = Curve(iso.UIsocurve)
iso_2 = IsoCurve(Surface=subsrf_2, UVPoint=cluster_2.pt_3)  # -> UIsocurve, VIsocurve
cluster_3 = Cluster_7(S=subsrf_2, D=cluster_2.I, crv_2=iso_2.UIsocurve, crv=iso_2.VIsocurve, D_2=cluster_2.I_2, num=num_3)  # -> V, U
cluster_4 = Cluster_8(S=subsrf, D=cluster_2.I, crv=crv, num=Slider(100, range=0..100))  # -> U, V
cluster_5 = Cluster_9(crv=cluster_4.V)  # -> R, C

# ----
# 垂直の場合の吹付パス
crv_2 = Curve(simplify(graft(cluster_5.R)))

# ----
# 角度をつけた吹付パスの作成
panel = Panel("100")
cluster_6 = Cluster_12(D=srf_2, crv=cluster_4.V)
cluster_7 = Cluster_12(D=cluster.S_2, crv=cluster_4.V)
divide = DivideCurve(Curve=reparameterize(crv_2), Count=panel, Kinks=False)  # -> Points, Tangents, Parameters
eval = EvaluateCurve(Curve=reparameterize(crv_2), Parameter=divide.Parameters)  # -> Point, Tangent, Angle
cluster_8 = Cluster_10(P=divide.Points, srf=cluster_7, D=cluster_6)  # -> T, simplify(P_2)
cluster_9 = Cluster_11(vec_2=cluster_8.T, vec=eval.Tangent, B=num_6)
neg_2 = Negative(Value=cluster_9)
multiplication = Multiplication(A=neg_2, B=x)
move = Move(Geometry=cluster_8.P_2, Motion=multiplication)  # -> Geometry, Transform
cluster_10 = Cluster_13(T=move.Geometry)

cluster_11 = Cluster_3(crv=cluster_3.U)
cluster_12 = Cluster_3(crv=cluster_3.V)
fillet = FilletDistance(Curve=cluster_11, Distance=num_5)
fillet_2 = FilletDistance(Curve=cluster_12, Distance=num_5)
divlength = DivideLength(Curve=fillet_2, Length=L)  # -> Points, Tangents, Parameters
divlength_2 = DivideLength(Curve=fillet, Length=L)  # -> Points, Tangents, Parameters
cluster_13 = Cluster_4(P=divlength.Points, srf=cluster_2.S_2, D=S)  # -> T, P_2
cluster_14 = Cluster_4(P=divlength_2.Points, srf=cluster_2.S_2, D=S)  # -> T, P_2
crv_3 = Curve(reparameterize(simplify(cluster_10)))
C = ClusterOutput(fillet_2)
C_2 = ClusterOutput(fillet)
i = ClusterOutput(cluster_14.T)
i_2 = ClusterOutput(cluster_13.T)
P = ClusterOutput(divlength_2.Points)
P_2 = ClusterOutput(divlength.Points)
divlength_3 = DivideLength(Curve=reparameterize(crv_3), Length=L)  # -> Points, Tangents, Parameters
cluster_15 = Cluster_4(P=divlength_3.Points, srf=graft(cluster.S_2), D=graft(srf_2))  # -> simplify(T), P_2
eval_2 = EvaluateCurve(Curve=reparameterize(crv_3), Parameter=divlength_3.Parameters)  # -> Point, Tangent, Angle
cluster_16 = Cluster_11(vec_2=cluster_15.T, vec=eval_2.Tangent, B=num_6)
crv_4 = ClusterOutput(crv_3)
C_3 = ClusterOutput(cluster_16)
P_3 = ClusterOutput(divlength_3.Points)

# ==== cluster Cluster_15
xy = XYPlane(Origin=Point(0, 0, 0))
O = ClusterInput()
X = ClusterInput()
Y = UnitY(Factor=1)
pl = ConstructPlane(Origin=graft(O), XAxis=X, YAxis=Y)
deplane = DeconstructPlane(Plane=pl)  # -> Origin, XAxis, YAxis, ZAxis
pl_2 = ConstructPlane(Origin=deplane.Origin, XAxis=deplane.ZAxis, YAxis=deplane.YAxis)
i = ClusterInput()
G = ClusterInput()
item = ListItem(List=flatten(pl_2), Index=i, Wrap=True)
orient = Orient(Geometry=G, Source=xy, Target=item)  # -> Geometry, Transform
G_2 = ClusterOutput(orient.Geometry)

# ==== cluster GHPythonRemote: Connects the Grasshopper Python component to an external Python instance.
python = PythonScript()  # -> default_working_dir
# ---------- python: Python ----------
from os import path
from Grasshopper.Folders import UserObjectFolders

cluster_comp = ghenv.Component.OnPingDocument().Owner
parent_doc_path = cluster_comp.OnPingDocument().FilePath

if parent_doc_path is not None:
    # Get path to parent GH document
    default_working_dir = path.abspath(path.dirname(parent_doc_path))
else:
    # Fallback to path to user objects default dir
    uo_folder = path.abspath(UserObjectFolders[0])
    if path.isdir(path.join(uo_folder, "gh-python-remote")):
        uo_folder = path.abspath(path.join(uo_folder, "gh-python-remote"))
    default_working_dir = uo_folder
# ---------- end python ----------
# GH to python remote example.
# ⓒ Pierre Cuvilliers, 2017-2022
# Released under the MIT license
# github.com/pilcru/ghpythonremote
# Runs and connects to an external python engine, and
# assigns imported modules to scriptcontext.sticky variables.
# 
# Arguments:
#       code (str): Path to the GH_to_python_sticky.py code file.
#       location (str): Path to a python executable, or to a folder
#             containing `python.exe`, or the name of a conda-created
#             virtual environment prefixed by `conda://` (`conda://env_name`).
#             If empty, finds python from your windows %PATH%.
#       run (boolean): Creates the connection, and imports new
#             modules, when turned to True. Kills the connection,
#             and deletes the references to the imports, when turned
#             to False.
#       modules (str list): List of module names to import in the
#             remote python. They will be added to the
#             scriptcontext.sticky dictionary, allowing them to be
#             reused from other python components in the same
#             Grasshopper document. Submodules (for example
#             `numpy.linalg` have to be added explicitly to this list
#             to be available later.
#       log_level (str from ['NOTSET', 'DEBUG', 'INFO', 'WARNING', 'ERROR', 'CRITICAL']):
#             Logging level to use for the local IronPython and the
#             remote python instance.
#       working_dir (str): Working directory for the remote python
#             instance.
# 
# Returns:
#       out (str): Console output with DEBUG information.
#       linked_modules (str list): list of imported module names.
#       rpy (rpyc connection object): The object representing the
#             remote Python interpreter.
location = ClusterInput()  # location (str): Path to a python executable, or to a folder containing `python.exe`, or the name of a conda-created virtual environment prefixed by `conda://` (`conda://env_name`). If empty, finds python from your windows %PATH%.
run = ClusterInput()  # run (boolean): Creates the connection, and imports new modules, when turned to True. Kills the connection,and deletes the references to the imports, when turned to False.
modules = ClusterInput()  # modules (str list): List of module names to import in the remote python. They will be added to the scriptcontext.sticky dictionary, allowing them to be reused from other python components in the same Grasshopper document. Submodules (for example `numpy.linalg` have to be added explicitly to this list to be available later.
list = ValueList({"CRITICAL", "ERROR", "WARNING", "INFO", "DEBUG", "NOTSET"}, selected="DEBUG")
panel = Panel(python)
ghpythonremote = GHPythonRemote(location=location, run=run, modules=modules, log_level=list, working_dir=panel)  # -> out, linked_modules, rpy; inputs run: Boolean, modules: list
# ---------- ghpythonremote: Python ----------
import inspect
import logging
from os import path
import sys
from time import sleep

import scriptcontext

import ghpythonremote
from ghpythonremote.connectors import GrasshopperToPythonRemote
from Grasshopper.Kernel.GH_RuntimeMessageLevel import Error, Warning

local_log_level = getattr(logging, log_level, logging.WARNING)
logger = logging.getLogger("ghpythonremote")
logger.setLevel(local_log_level)
ch = logging.StreamHandler()
ch.setLevel(local_log_level)
formatter = logging.Formatter("%(levelname)s: %(name)s:\n%(message)s")
ch.setFormatter(formatter)
logger.handlers = []
logger.addHandler(ch)
logger = logging.getLogger("ghpythonremote.GH_to_python")

ROOT = path.abspath(path.dirname(inspect.getfile(ghpythonremote)))
rpyc_server_py = path.join(ROOT, "pythonservice.py")

cluster_comp = ghenv.Component.OnPingDocument().Owner

# Set connection to CLOSED if this is the first run
# and initialize set of linked modules
try:
    remote_python_status
except NameError:
    remote_python_status = "CLOSED"
    lkd_modules = set()

# Wait for connection to connect or terminate
timer = 0
while remote_python_status == "CONNECTING" or remote_python_status == "CLOSING":
    sleep(1)
    timer += 1
    if timer == 10:
        try:
            gh2py_manager.__exit__(*sys.exc_info())
        except Exception:
            pass
        remote_python_status = "CLOSED"
        lkd_modules = set()
        message = (
            "Connection left in an inconsistent state and not returning. Reset "
            "everything."
        )
        if cluster_comp is not None:
            cluster_comp.AddRuntimeMessage(Warning, message)
        raise RuntimeError(message)

if run:
    if not remote_python_status == "OPEN":
        remote_python_status = "CONNECTING"
        gh2py_manager = GrasshopperToPythonRemote(
            rpyc_server_py,
            location=location,
            timeout=10,
            port=None,
            log_level=log_level,
            working_dir=working_dir,
        )
        gh2py = gh2py_manager.__enter__()
        remote_python_status = "OPEN"

    # Stuff that we can reach
    rpymod = gh2py.py_remote_modules  # A getter function for a named python module
    rpy = gh2py.connection  # Represents the remote instance root object
    scriptcontext.sticky["rpy"] = rpy
    # Add modules
    for mod in modules:
        try:
            scriptcontext.sticky[mod] = rpymod(mod)
            lkd_modules.add(mod)
        except ImportError:
            gh2py_manager.__exit__(*sys.exc_info())
            if cluster_comp is not None:
                cluster_comp.AddRuntimeMessage(
                    Error,
                    'Could not import module "{}" in remote Python.'.format(mod)
                )
            raise
        except EOFError:
            if cluster_comp is not None:
                cluster_comp.AddRuntimeMessage(
                    Error,
                    'Remote Python has been closed unexpectedly'
                )
            raise

elif not remote_python_status == "CLOSED":
    remote_python_status = "CLOSING"
    # Remove linked modules
    for mod in lkd_modules:
        del scriptcontext.sticky[mod]
    del scriptcontext.sticky["rpy"]
    gh2py_manager.__exit__(*sys.exc_info())
    lkd_modules = set()
    remote_python_status = "CLOSED"

# Change variable name because ghpython resets outputs to None before each run
linked_modules = lkd_modules

logger.info("GH to python connection is {}".format(remote_python_status))
# ---------- end ghpythonremote ----------
out = ClusterOutput(ghpythonremote.out)  # Console output.
linked_modules = ClusterOutput(ghpythonremote.linked_modules)  # Names of modules that were successfully added to the scriptcontext.sticky dictionary.
rpy = ClusterOutput(ghpythonremote.rpy)  # The object representing the remote python instance
python_2 = PythonScript(module_names=ghpythonremote.linked_modules)  # -> import_statements; inputs module_names: list
# ---------- python_2: Python ----------
import_statements = ["import scriptcontext as sc"]
for module_name in module_names:
    import_statements.append("{0} = sc.sticky['{0}']".format(module_name))

if len(module_names) == 0:
    import_statements = []
# ---------- end python_2 ----------
import_statements = ClusterOutput(python_2)  # Useful import statements to use the imported modules in your scripts.

# ==== cluster Cluster_16
L = ClusterInput()
split = SplitList(List=L, Index="1")  # -> flatten(ListA), simplify(ListB)
flip = FlipMatrix(Data=split.ListB)
split_2 = SplitList(List=flip, Index="2")  # -> simplify(ListA), simplify(ListB)
index = ClusterOutput(split.ListA)
flip_2 = FlipMatrix(Data=split_2.ListA)
python = GhPythonScript(x=split_2.ListB)  # -> out, Markers; inputs x: tree
# ---------- python: Python ----------
__author__ = "shimono"
__version__ = "2025.02.17"

import rhinoscriptsyntax as rs
import ghpythonlib.components as ghcomp
import System
import Grasshopper.Kernel.Data.GH_Path as GH_Path
import Grasshopper.DataTree as DataTree

Markers = DataTree[System.Object]()


for i in range(x.BranchCount):
    branchList = x.Branch(i)
    
    for j in range(branchList.Count):
        mod = j % 3
        
        if mod == 0:
            TmpCooList = []
        
        TmpCooList.append(1000000 if branchList[j] == "" else float(branchList[j]))
        
        if mod == 2:
            p = ghcomp.ConstructPoint(TmpCooList[0], TmpCooList[1], TmpCooList[2])
            
            key = int(j/3)
            path = GH_Path(key)
            Markers.Add(p, path)
# ---------- end python ----------
bang = ExplodeTree(Data=flip_2)  # -> Branch0, Branch1
bang_2 = ExplodeTree(Data=python.Markers)  # -> Branch0, Branch1
time = ClusterOutput(bang.Branch0)
step = ClusterOutput(bang.Branch1)
iphone = ClusterOutput(bang_2.Branch0)
direction = ClusterOutput(bang_2.Branch1)

# ==== cluster Cluster_3
crv = ClusterInput()
crv_2 = Curve(flatten(crv))
cull = CullPattern(List=crv_2, CullPattern=[True, False])  # -> graft(List)
cull_2 = CullPattern(List=crv_2, CullPattern=[False, True])  # -> graft(List)
flip = FlipCurve(Curve=cull)  # -> Curve, Flag
merge = Merge(Data1=flip.Curve, Data2=cull_2)  # -> flatten(Result)
connect = ConnectCurves(Curves=merge, Continuity="0", Close=False, Bulge=1)
C = ClusterOutput(connect)

# ==== cluster Cluster_4
srf = ClusterInput()
P = ClusterInput()
srf_2 = Surface(srf)
pt = Point(P)
srf_cp = SurfaceClosestPoint(Point=P, Surface=reparameterize(srf_2))  # -> Point, UVPoint, Distance
evalsrf = EvaluateSurface(Surface=reparameterize(srf_2), Point=srf_cp.UVPoint)  # -> Point, unitize(simplify(Normal)), UDirection, VDirection, Frame
pt_2 = Point(srf_cp.Point)
neg = Negative(Value=evalsrf.Normal)
vec = Vector(evalsrf.Normal)
move = Move(Geometry=pt_2, Motion=vec)  # -> Geometry, Transform
move_2 = Move(Geometry=pt_2, Motion=neg)  # -> Geometry, Transform
merge = Merge(Data1=simplify(graft(vec)), Data2=simplify(graft(neg)))
merge_2 = Merge(Data1=simplify(graft(move.Geometry)), Data2=simplify(graft(move_2.Geometry)))
D = ClusterInput()
tstat = TreeStatistics(Tree=move.Geometry)  # -> Paths, Length, Count
dup = DuplicateData(Data=D, Number=graft(tstat.Length), Order=True)  # -> simplify(graft(Data))
srf_cp_2 = SurfaceClosestPoint(Point=merge_2, Surface=dup)  # -> Point, UVPoint, Distance
dist = Distance(PointA=merge_2, PointB=srf_cp_2.Point)
sort = SortList(Keys=dist, ValuesA=merge)  # -> Keys, ValuesA
srf_cp_3 = SurfaceClosestPoint(Point=graft(pt_2), Surface=dup)  # -> Point, UVPoint, Distance
item = ListItem(List=sort.ValuesA, Index=0, Wrap=True)
flatten = FlattenTree(Tree=item, Path="{0}")
tstat_2 = TreeStatistics(Tree=item)  # -> Paths, Length, Count
lng = ListLength(List=flatten)
P_2 = ClusterOutput(srf_cp_3.Point)
python = GhPythonScript(x=tstat_2.Count, y=lng)  # -> out, a
# ---------- python: Python ----------
__author__ = "hiroki-awaji"
__version__ = "2024.02.10"

import rhinoscriptsyntax as rs
if x==y:
    a = 0
else:
    a = 1
# ---------- end python ----------
trim = TrimTree(Tree=item, Depth=python.a)
T = ClusterOutput(trim)

# ==== cluster Cluster_5
range = Range(Domain=Domain(0, 1), Steps=10)
S = ClusterInput()
D = ClusterInput()
offset = OffsetSurface(Surface=S, Distance=D, Retrim=True)
pt = ConstructPoint(XCoordinate=range, YCoordinate=range, ZCoordinate=0)
iso = IsoCurve(Surface=reparameterize(offset), UVPoint=pt)  # -> UIsocurve, VIsocurve
S_2 = ClusterOutput(offset)
crv = Curve(iso.UIsocurve)
crv_2 = Curve(iso.VIsocurve)
panel = Panel(pt)
num = ClusterInput()
len = Length(Curve=crv)
len_2 = Length(Curve=crv_2)
avr = Average(Input=flatten(len))
avr_2 = Average(Input=flatten(len_2))
num_2 = Number(num)
division = Division(A=num_2, B=avr)
division_2 = Division(A=num_2, B=avr_2)
subtraction = Subtraction(A=1, B=division_2)
subtraction_2 = Subtraction(A=1, B=division)
dom = ConstructDomain(DomainStart=division, DomainEnd=subtraction_2)
dom_2 = ConstructDomain(DomainStart=division_2, DomainEnd=subtraction)
dom²num = ConstructDomain²(UMin=division, UMax=subtraction_2, VMin=division_2, VMax=subtraction)
I = ClusterOutput(dom)
I_2 = ClusterOutput(dom_2)
i² = ClusterOutput(dom²num)
pt_2 = ConstructPoint(XCoordinate=division, YCoordinate=division_2, ZCoordinate=0)
pt_3 = ClusterOutput(pt_2)

# ==== cluster Cluster_6
range = Range(Domain=Domain(0, 1), Steps=10)
S = ClusterInput()
D = ClusterInput()
offset = OffsetSurface(Surface=S, Distance=D, Retrim=True)
pt = ConstructPoint(XCoordinate=range, YCoordinate=range, ZCoordinate=0)
iso = IsoCurve(Surface=reparameterize(graft(offset)), UVPoint=pt)  # -> UIsocurve, VIsocurve
S_2 = ClusterOutput(offset)
crv = Curve(iso.UIsocurve)
crv_2 = Curve(iso.VIsocurve)
num = ClusterInput()
len = Length(Curve=crv)
len_2 = Length(Curve=crv_2)
trim = TrimTree(Tree=len, Depth=1)
trim_2 = TrimTree(Tree=len_2, Depth=1)
num_2 = Number(num)
avr = Average(Input=trim_2)
avr_2 = Average(Input=trim)
division = Division(A=num_2, B=avr_2)
division_2 = Division(A=num_2, B=avr)
subtraction = Subtraction(A=1, B=division_2)
subtraction_2 = Subtraction(A=1, B=division)
dom = ConstructDomain(DomainStart=division, DomainEnd=subtraction_2)
dom_2 = ConstructDomain(DomainStart=division_2, DomainEnd=subtraction)
dom²num = ConstructDomain²(UMin=division, UMax=subtraction_2, VMin=division_2, VMax=subtraction)
I = ClusterOutput(dom)
I_2 = ClusterOutput(dom_2)
i² = ClusterOutput(dom²num)
pt_2 = ConstructPoint(XCoordinate=division, YCoordinate=division_2, ZCoordinate=0)
pt_3 = ClusterOutput(pt_2)

# ==== cluster Cluster_7
num = ClusterInput()
num_2 = Number(num)
crv = ClusterInput()
crv_2 = ClusterInput()
crv_3 = Curve(crv)
crv_4 = Curve(crv_2)
len = Length(Curve=crv_4)
len_2 = Length(Curve=crv_3)
division = Division(A=len, B=num_2)
division_2 = Division(A=len_2, B=num_2)
round = Round(Number=division)  # -> Nearest, Floor, Ceiling
D = ClusterInput()
D_2 = ClusterInput()
round_2 = Round(Number=division_2)  # -> Nearest, Floor, Ceiling
range = Range(Domain=D, Steps=round.Floor)
range_2 = Range(Domain=D_2, Steps=round_2.Floor)
python = GhPythonScript()  # -> out, a
# ---------- python: Python ----------
__author__ = "hiroki-awaji"
__version__ = "2024.02.10"

import rhinoscriptsyntax as rs
if x==False and y==False and z==False and u==False and v==False:
    a = 0
elif x==True and y==False and z==False and u==False and v==False:
    a = tx 
elif x==True and y==True and z==False and u==False and v==False:
    a = ty
elif x==True and y==True and z==True and u==False and v==False:
    a = tz  
elif x==True and y==True and z==True and u==True and v==False:
    a = tu
elif x==True and y==True and z==True and u==True and v==True:
    a = tv
# ---------- end python ----------
pt = ConstructPoint(XCoordinate=range, YCoordinate=0, ZCoordinate=0)
pt_2 = ConstructPoint(XCoordinate=0, YCoordinate=range_2, ZCoordinate=0)
S = ClusterInput()
iso = IsoCurve(Surface=reparameterize(S), UVPoint=pt_2)  # -> UIsocurve, VIsocurve
iso_2 = IsoCurve(Surface=reparameterize(S), UVPoint=pt)  # -> UIsocurve, VIsocurve
V = ClusterOutput(iso_2.VIsocurve)
U = ClusterOutput(iso.UIsocurve)

# ==== cluster Cluster_8
num = ClusterInput()
num_2 = Number(num)
crv = ClusterInput()
crv_2 = Curve(crv)
len = Length(Curve=crv_2)
division = Division(A=len, B=num_2)
round = Round(Number=division)  # -> Nearest, Floor, Ceiling
D = ClusterInput()
python = GhPythonScript(x=round.Floor)  # -> out, a
# ---------- python: Python ----------
__author__ = "hiroki-awaji"
__version__ = "2024.02.10"

import rhinoscriptsyntax as rs
if x==0:
    a = 1
else:
    a = 2
# ---------- end python ----------
range = Range(Domain=D, Steps=python.a)
S = ClusterInput()
pt = ConstructPoint(XCoordinate=range, YCoordinate=0, ZCoordinate=0)
iso = IsoCurve(Surface=reparameterize(S), UVPoint=pt)  # -> UIsocurve, VIsocurve
U = ClusterOutput(iso.UIsocurve)
V = ClusterOutput(iso.VIsocurve)

# ==== cluster Cluster_9
crv = ClusterInput()
crv_2 = Curve(simplify(crv))
trim = TrimTree(Tree=crv_2, Depth=1)
cull = CullPattern(List=trim, CullPattern=[True, False])
cull_2 = CullPattern(List=trim, CullPattern=[False, True])
flip = FlipCurve(Curve=cull)  # -> Curve, Flag
merge = Merge(Data1=simplify(flip.Curve), Data2=simplify(cull_2))
connect = ConnectCurves(Curves=merge, Continuity="0", Close=False, Bulge=1)
R = ClusterOutput(merge)
C = ClusterOutput(connect)

# ==== cluster Cluster_10
srf = ClusterInput()
P = ClusterInput()
trim = TrimTree(Tree=simplify(P), Depth=1)
srf_2 = Surface(srf)
tstat = TreeStatistics(Tree=trim)  # -> Paths, Length, Count
dup = DuplicateData(Data=srf_2, Number=2, Order=True)
pt = Point(P)
srf_cp = SurfaceClosestPoint(Point=P, Surface=reparameterize(srf_2))  # -> Point, UVPoint, Distance
panel = Panel(P)
evalsrf = EvaluateSurface(Surface=reparameterize(srf_2), Point=srf_cp.UVPoint)  # -> Point, unitize(simplify(Normal)), UDirection, VDirection, Frame
pt_2 = Point(srf_cp.Point)
neg = Negative(Value=evalsrf.Normal)
vec = Vector(evalsrf.Normal)
move = Move(Geometry=pt_2, Motion=vec)  # -> Geometry, Transform
move_2 = Move(Geometry=pt_2, Motion=neg)  # -> Geometry, Transform
merge = Merge(Data1=simplify(graft(vec)), Data2=simplify(graft(neg)))
merge_2 = Merge(Data1=simplify(graft(move.Geometry)), Data2=simplify(graft(move_2.Geometry)))
D = ClusterInput()
tstat_2 = TreeStatistics(Tree=move.Geometry)  # -> Paths, Length, Count
dup_2 = DuplicateData(Data=D, Number=graft(tstat_2.Length), Order=True)  # -> simplify(graft(Data))
srf_cp_2 = SurfaceClosestPoint(Point=merge_2, Surface=dup_2)  # -> Point, UVPoint, Distance
dist = Distance(PointA=merge_2, PointB=srf_cp_2.Point)
sort = SortList(Keys=dist, ValuesA=merge)  # -> Keys, ValuesA
srf_cp_3 = SurfaceClosestPoint(Point=graft(pt_2), Surface=dup_2)  # -> Point, UVPoint, Distance
item = ListItem(List=sort.ValuesA, Index=0, Wrap=True)
flatten = FlattenTree(Tree=item, Path="{0}")
tstat_3 = TreeStatistics(Tree=item)  # -> Paths, Length, Count
lng = ListLength(List=flatten)
P_2 = ClusterOutput(srf_cp_3.Point)
python = GhPythonScript(x=tstat_3.Count, y=lng)  # -> out, a; same code as python
trim_2 = TrimTree(Tree=item, Depth=python.a)
T = ClusterOutput(trim_2)

# ==== cluster Cluster_11
B = ClusterInput()
subtraction = Subtraction(A="90", B=B)
vec = ClusterInput()
vec_2 = ClusterInput()
vec_3 = Vector(simplify(graft(vec)))
rad = Radians(Degrees=subtraction)
vec_4 = Vector(simplify(vec_2))
neg = Negative(Value=rad)
vrot = Rotate(Vector=vec_4, Axis=vec_3, Angle=rad)  # -> unitize(Vector)
vrot_2 = Rotate(Vector=vec_4, Axis=vec_3, Angle=neg)  # -> unitize(Vector)
Z = UnitZ(Factor=1)
merge = Merge(Data1=simplify(vrot), Data2=simplify(vrot_2))
neg_2 = Negative(Value=Z)
cvec = ClosestVector(Reference=neg_2, Targets=merge, KeepLength=False)  # -> unitize(simplify(Closest)), Index, Angle
C = ClusterOutput(cvec.Closest)

# ==== cluster Cluster_12
crv = ClusterInput()
crv_2 = Curve(simplify(crv))
trim = TrimTree(Tree=crv_2, Depth=1)
tstat = TreeStatistics(Tree=trim)  # -> Paths, Length, Count
D = ClusterInput()
dup = DuplicateData(Data=graft(D), Number=graft(tstat.Length), Order=True)  # -> simplify(graft(Data))
D_2 = ClusterOutput(dup)

# ==== cluster Cluster_13
T = ClusterInput()
trim = TrimTree(Tree=T, Depth=1)
intcrv = Interpolate(Vertices=trim, Degree=3, Periodic=False, KnotStyle=1)  # -> Curve, Length, Domain
trim_2 = TrimTree(Tree=intcrv.Curve, Depth=1)
connect = ConnectCurves(Curves=trim_2, Continuity=2, Close=False, Bulge=0)
C = ClusterOutput(connect)
