# Grasshopper definition Path Viz.gh (Grasshopper 1.0.8)
# plug-ins: RemoSharp

# Input
toggle = BooleanToggle(True)
panel = Panel("A_1")
path = FilePath("C:\Users\akhaj\source\repos\agb\robot_ik\path_determinations\tool_path_20260405\PASS_01.csv")
file = ReadFile(File=path, PerLineParse=True)
flatten = FlattenTree(Tree=file, Path="{0}")
lng = ListLength(List=flatten)
multiplication = Multiplication(A=Slider(0.437, range=0..1), B=lng)
multiplication_2 = Multiplication(A=Slider(0.99, range=0..1), B=lng)
dom = ConstructDomain(DomainStart=multiplication, DomainEnd=multiplication_2)
subset = SubList(List=flatten, Domain=dom, Wrap=True)  # -> List, Index
number_slider = Slider(7, range=0..100)
split = TextSplit(Text=subset.List, Separators=",")
item = ListItem(List=split, Index=0, Wrap=True)  # -> Item, Item1, Item2, Item3, Item4, Item5
neg = Negative(Value=number_slider)
Z = UnitZ(Factor=neg)
division = Division(A=number_slider, B=Slider(2, range=0..10))
pt = ConstructPoint(XCoordinate=item.Item, YCoordinate=item.Item1, ZCoordinate=item.Item2)
xy = XYPlane(Origin=pt)
rotpl = RotatePlane(
    plane=xy,
    X=Slider(0, range=-180..180),
    Y=Slider(0, range=-180..180),
    Z=Slider(0, range=-180..180),
    flip=False,
    glb=False)
cone = Cone(Base=PlaneXY(0, 0, 0), Radius=division, Length=number_slider)  # -> Cone, Tip
move = Move(Geometry=cone.Cone, Motion=Z)  # -> Geometry, Transform
rotpl_2 = RotatePlane(plane=rotpl, X=item.Item3, Y=item.Item4, Z=item.Item5, flip=False, glb=False)
mesh = Mesh(move.Geometry)
orient = Orient(Geometry=mesh, Source=PlaneXY(0, 0, 0), Target=rotpl_2)  # -> Geometry, Transform
