# Grasshopper definition gh_client_linear_motion_2.gh (Grasshopper 1.0.8)
# plug-ins: CollabFabGH, RemoSharp

geo = Geometry(<brep referenced from the Rhino model>)
bbox = BoundingBox(Content=geo, Plane=PlaneXY(0, 0, 0))  # -> Box, Box_2
debrep = DeconstructBrep(Brep=bbox.Box)  # -> Faces, Edges, Vertices
pdecon = Deconstruct(Point=debrep.Vertices)  # -> XComponent, YComponent, ZComponent
area = Area(Geometry=debrep.Faces)  # -> Area, Centroid
division = Division(A=Slider(1, range=0..1), B=area.Area)
sort = SortList(Keys=division, ValuesA=debrep.Faces)  # -> Keys, ValuesA
number_slider = Slider(10, range=0..1000)
item = ListItem(List=sort.ValuesA, Index=0, Wrap=True)
neg = Negative(Value=number_slider)
crv = Curve(item)
Z = UnitZ(Factor=Slider(841, range=0..1000))
offset = OffsetCurve(Curve=crv, Distance=number_slider, Corners=1)
offset_2 = OffsetCurve(Curve=crv, Distance=neg, Corners=1)
division_2 = Division(A=Z, B=-2)
boundary = BoundarySurfaces(Edges=[offset, offset_2])
move = Move(Geometry=boundary, Motion=division_2)  # -> Geometry, Transform
extr = Extrude(Base=move.Geometry, Direction=Z)
debrep_2 = DeconstructBrep(Brep=geo)  # -> Faces, Edges, Vertices
sdiff = SolidDifference(BrepsA=geo, BrepsB=extr)
sort_2 = SortList(Keys=pdecon.ZComponent, ValuesA=debrep.Vertices)  # -> Keys, ValuesA
Z_2 = UnitZ(Factor=1)
item_2 = ListItem(List=sort_2.ValuesA, Index=0, Wrap=True)
pt = ConstructPoint(XCoordinate="0.5", YCoordinate="0.5", ZCoordinate=0)
srf = Surface(debrep_2.Faces)
contour = Contour(Shape=sdiff, Point=item_2, Direction=Z_2, Distance=Slider(36, range=0..100))
evalsrf = EvaluateSurface(Surface=reparameterize(srf), Point=pt)  # -> Point, Normal, UDirection, VDirection, Frame
Z_3 = UnitZ(Factor=1)
dprod = DotProduct(VectorA=Z_3, VectorB=evalsrf.Normal, Unitize=False)
area_2 = Area(Geometry=contour)  # -> Area, Centroid
abs = Absolute(Value=dprod)
sort_3 = SortList(Keys=area_2.Area, ValuesA=contour)  # -> Keys, ValuesA
smaller = SmallerThan(FirstNumber=abs, SecondNumber=Slider(0.01, range=0..0.01))  # -> SmallerThan, OrEqualTo
graft = GraftTree(Tree=sort_3.ValuesA, IncludeEmptyLists=True, IncludeNullItems=True)
dispatch = Dispatch(List=debrep_2.Faces, DispatchPattern=smaller.OrEqualTo)  # -> ListA, ListB
explode = Explode(Curve=graft, Recursive=True)  # -> Segments, Vertices
boundary_2 = BoundarySurfaces(Edges=graft)
geo_2 = Geometry(dispatch.ListB)
join = BrepJoin(Breps=geo_2)  # -> Breps, Closed
trim = TrimTree(Tree=explode.Vertices, Depth=1)
trim_2 = TrimTree(Tree=join.Breps, Depth=1)
area_3 = Area(Geometry=trim_2)  # -> Area, Centroid
panel = Panel(trim_2)
pdecon_2 = Deconstruct(Point=trim)  # -> XComponent, YComponent, ZComponent
sort_4 = SortList(Keys=pdecon_2.YComponent, ValuesA=trim)  # -> Keys, ValuesA
number_slider_2 = Slider(50, range=0..100)
sort_5 = SortList(Keys=area_3.Area, ValuesA=trim_2)  # -> Keys, ValuesA
Z_4 = UnitZ(Factor=1)
X = UnitX(Factor=1)
item_3 = ListItem(List=sort_4.ValuesA, Index=0, Wrap=True)
item_4 = ListItem(List=sort_5.ValuesA, Index=0, Wrap=True)  # -> Item1, Item
contour_2 = Contour(Shape=boundary_2, Point=item_3, Direction=X, Distance=Slider(245, range=0..1000))
trim_3 = TrimTree(Tree=contour_2, Depth=1)
c_script = CSharpScript(x=trim_3)  # -> out, a; inputs x: list of Curve
# ---------- c_script: C# ----------
// Grasshopper Script Instance
#region Usings
using System;
using System.Linq;
using System.Collections;
using System.Collections.Generic;
using System.Drawing;

using Rhino;
using Rhino.Geometry;

using Grasshopper;
using Grasshopper.Kernel;
using Grasshopper.Kernel.Data;
using Grasshopper.Kernel.Types;
#endregion

public class Script_Instance : GH_ScriptInstance
{
    #region Notes
    /* 
      Members:
        RhinoDoc RhinoDocument
        GH_Document GrasshopperDocument
        IGH_Component Component
        int Iteration

      Methods (Virtual & overridable):
        Print(string text)
        Print(string format, params object[] args)
        Reflect(object obj)
        Reflect(object obj, string method_name)
    */
    #endregion

    private void RunScript(List<Curve> x, object y, ref object a)
    {
        List<Curve> crvs = new ();
        for (int i = 0; i < x.Count; i++){
            var crv = x[i];
            var st = crv.PointAtStart;
            var ed = crv.PointAtEnd;

            if (st.Y > ed.Y) crv.Reverse();
            if (i % 2 != 0) crv.Reverse();

            crvs.Add(crv);
        }
        // Write your logic here
        a = crvs;
    }
}
# ---------- end c_script ----------
divlength = DivideLength(Curve=c_script.a, Length=Slider(100, range=0..100))  # -> Points, Tangents, Parameters
lng = ListLength(List=divlength.Points)
simplify = SimplifyTree(Tree=lng, Front=False)
trim_4 = TrimTree(Tree=simplify, Depth=1)
divide = DivideCurve(Curve=c_script.a, Count=trim_4, Kinks=False)  # -> Points, Tangents, Parameters
trim_5 = TrimTree(Tree=divide.Points, Depth=1)
number_slider_3 = Slider(100, range=0..100)
graft_2 = GraftTree(Tree=trim_5, IncludeEmptyLists=True, IncludeNullItems=True)
srf_cp = SurfaceClosestPoint(Point=graft_2, Surface=item_4.Item1)  # -> Point, UVPoint, Distance
pline = PolyLine(Vertices=trim_5, Closed=False)
evalsrf_2 = EvaluateSurface(Surface=item_4.Item1, Point=srf_cp.UVPoint)  # -> Point, Normal, UDirection, VDirection, Frame
Y = UnitY(Factor=1)
Z_5 = UnitZ(Factor=1)
pl = ConstructPlane(Origin=graft_2, XAxis=evalsrf_2.Normal, YAxis=Y)
panel_2 = Panel(evalsrf_2.Normal)
panel_3 = Panel("""{
    "frame_id": "world",
    "link_name": "spray_cone.stp",
    "position": {
        "x": 4.964577986351439,
        "y": 0.17737618602351413,
        "z": 1.4043397856321738
    },
    "orientation": {
        "x": 0.5549891617281286,
        "y": 0.07194700765535188,
        "z": 0.820903447402369,
        "w": 0.11370219213654598
    },
    "source": "moveit/compute_fk"
}""")
rotpl = RotatePlane(plane=pl, X=0, Y=0, Z=Slider(180, range=0..1000), flip=False, glb=False)
multiplication = Multiplication(A=Slider(320, range=0..1000), B=evalsrf_2.Normal)
rev = Reverse(Vector=multiplication)
move_2 = Move(Geometry=rotpl, Motion=rev)  # -> Geometry, Transform
button = Button()
number_slider_4 = Slider(0, range=-30..30)
number_slider_5 = Slider(0, range=-30..30)
flatten = FlattenTree(Tree=move_2.Geometry, Path="{0}")
ipy2 = IronPython2Script(x=panel_3)  # -> out, a; inputs x: String
# ---------- ipy2: IronPython ----------
import json
"""Grasshopper Script"""
obj = json.loads(x)

X = obj["position"]["x"]*1000
Y = obj["position"]["y"]*1000
Z = obj["position"]["z"]*1000


x = obj["orientation"]["x"]
y = obj["orientation"]["y"]
z = obj["orientation"]["z"]
w = obj["orientation"]["w"]

a = [X,Y,Z,w,z,y,x]
# ---------- end ipy2 ----------
pline_2 = PolyLine(Vertices=flatten, Closed=False)
trigger = Trigger(Interval=200, TimerInterval=200, Target=c_script_2)  # disabled
number_slider_6 = Slider(0, range=0..127)
c_script_2 = CSharpScript(req=Toggle(False))  # -> out, a; inputs req: Boolean; disabled
# ---------- c_script_2: C# ----------
// Grasshopper Script Instance
#region Usings
using System;
using System.Linq;
using System.Collections;
using System.Collections.Generic;
using System.Drawing;

using Rhino;
using Rhino.Geometry;

using Grasshopper;
using Grasshopper.Kernel;
using Grasshopper.Kernel.Data;
using Grasshopper.Kernel.Types;

using System.Net.Http;
using System.Text.Json;
using System.Threading.Tasks;
#endregion

public class Script_Instance : GH_ScriptInstance
{
    #region Notes
    /* 
      Members:
        RhinoDoc RhinoDocument
        GH_Document GrasshopperDocument
        IGH_Component Component
        int Iteration

      Methods (Virtual & overridable):
        Print(string text)
        Print(string format, params object[] args)
        Reflect(object obj)
        Reflect(object obj, string method_name)
    */
    #endregion

    private void RunScript(bool req, ref object a)
    {
        var url = "http://172.21.1.108:8000/current_pose/";

        using var client = new HttpClient();

        var response = client.GetAsync(url).Result;
        response.EnsureSuccessStatusCode();

        var json = response.Content.ReadAsStringAsync().Result;

        using var doc = JsonDocument.Parse(json);
        var root = doc.RootElement;

        var pos = root.GetProperty("position");
        var ori = root.GetProperty("orientation");

        var pose = new List<double>
        {
            pos.GetProperty("x").GetDouble()*1000,
            pos.GetProperty("y").GetDouble()*1000,
            pos.GetProperty("z").GetDouble()*1000,
            ori.GetProperty("w").GetDouble(),
            ori.GetProperty("x").GetDouble(),
            ori.GetProperty("y").GetDouble(),
            ori.GetProperty("z").GetDouble(),
        };

        a = pose;
    }
}
# ---------- end c_script_2 ----------
xy = XYPlane(Origin=flatten)
xy_2 = XYPlane(Origin=flatten)
neg_2 = Negative(Value=number_slider_5)
neg_3 = Negative(Value=number_slider_4)
pt_2 = Point([Point(4891.776028, 177.3369784, 1403.152607), Point(4891.776028, 677.3369784, 1403.152607), Point(4891.776028, 1177.336978, 1403.152607), Point(4391.776028, 1177.336978, 1403.152607), Point(4391.776028, 677.3369784, 1403.152607), Point(4391.776028, 177.3369784, 1403.152607), Point(3891.776028, 177.3369784, 1403.152607), Point(3891.776028, 677.3369784, 1403.152607), Point(3891.776028, 1177.336978, 1403.152607)])
panel_4 = Panel("""0
8""")
panel_5 = Panel("""start
end""")
panel_6 = Panel("C:\Users\akhaj\source\repos\agb\robot_ik\ref\path_linear_test_")
lng_2 = ListLength(List=xy)  # -> expr("x -1", Length)
lng_3 = ListLength(List=xy_2)  # -> expr("x -1", Length)
dom = ConstructDomain(DomainStart=number_slider_5, DomainEnd=neg_2)
dom_2 = ConstructDomain(DomainStart=number_slider_4, DomainEnd=neg_3)
cctr = CoordinateConvertor(Pose=c_script_2.a, Plane=PlaneXY(0, 0, 0))  # -> Plane, Pose; disabled
range = Range(Domain=dom, Steps=lng_2)
range_2 = Range(Domain=dom_2, Steps=lng_3)
Z_6 = UnitZ(Factor=Slider(20, range=0..100))
item_5 = ListItem(List=pt_2, Index=panel_4, Wrap=True)
c_script_3 = CSharpScript()  # -> out, a
# ---------- c_script_3: C# ----------
// Grasshopper Script Instance
#region Usings
using System;
using System.Linq;
using System.Collections;
using System.Collections.Generic;
using System.Drawing;

using Rhino;
using Rhino.Geometry;

using Grasshopper;
using Grasshopper.Kernel;
using Grasshopper.Kernel.Data;
using Grasshopper.Kernel.Types;
#endregion

public class Script_Instance : GH_ScriptInstance
{
    #region Notes
    /* 
      Members:
        RhinoDoc RhinoDocument
        GH_Document GrasshopperDocument
        IGH_Component Component
        int Iteration

      Methods (Virtual & overridable):
        Print(string text)
        Print(string format, params object[] args)
        Reflect(object obj)
        Reflect(object obj, string method_name)
    */
    #endregion

    private void RunScript(object x, object y, ref object a)
    {
        // Write your logic here
        var indecies = GetOrderedPaths(9);
        DataTree<int> tree = new DataTree<int>();
        for (int i = 0; i < indecies.Count; i++){
tree.AddRange(indecies[i],new GH_Path(i));
        }
        a = tree;
    }

    public static List<List<int>> GetOrderedPaths(int pointCount)
    {
        if (pointCount < 2)
            throw new ArgumentException("pointCount must be at least 2.");

        int start = 0;
        int end = pointCount - 1;

        int intermediateCount = pointCount - 2;
        int pathCount = 1 << intermediateCount;

        var paths = new List<List<int>>();

        for (int mask = 0; mask < pathCount; mask++)
        {
            var path = new List<int>();
            path.Add(start);

            for (int i = 0; i < intermediateCount; i++)
            {
                if ((mask & (1 << i)) != 0)
                {
                    path.Add(i + 1);
                }
            }

            path.Add(end);
            paths.Add(path);
        }

        return paths;
    }
}
# ---------- end c_script_3 ----------
number_slider_7 = Slider(300, range=10..300)
addition = Addition(A=item_5, B=Z_6)
rotpl_2 = RotatePlane(plane=flatten, X=0, Y=range_2, Z=range, flip=False, glb=False)  # -> graft(Plane)
item_6 = ListItem(List=pt_2, Index=c_script_3.a, Wrap=True)

pline_3 = PolyLine(Vertices=item_6, Closed=False)
item_7 = ListItem(List=flatten(pline_3), Index=Slider(0, range=0..127), Wrap=True)

tag = TextTag(Location=addition, Text=panel_5)
button_2 = Button()
cctr_2 = CoordinateConvertor(Pose=[0, 0, 0, 1, 0, 0, 0], Plane=rotpl_2)  # -> Plane, Pose
cctr_3 = CoordinateConvertor(Pose=[0, 0, 0, 1, 0, 0, 0], Plane=rotpl_2)  # -> Plane, Pose
rec = DataRecorder(Button(), DataLimit=-10, RecordData=True)
flatten_2 = FlattenTree(Tree=rotpl_2, Path="{0}")
flatten_3 = FlattenTree(Tree=pline_3, Path="{0}")
subset = SubList(List=cctr_2.Pose, Domain="0 to 2", Wrap=True)  # -> List, Index
subset_2 = SubList(List=cctr_2.Pose, Domain="3 to 6", Wrap=True)  # -> List, Index
int = Integer(rec)
item_8 = ListItem(List=flatten_2, Index=0, Wrap=True)  # -> Item1, Item
or = GateOr(A=button_2, B=Toggle(True))
c_script_4 = CSharpScript()  # -> out, a
# ---------- c_script_4: C# ----------
// Grasshopper Script Instance
#region Usings
using System;
using System.Linq;
using System.Collections;
using System.Collections.Generic;
using System.Drawing;

using Rhino;
using Rhino.Geometry;

using Grasshopper;
using Grasshopper.Kernel;
using Grasshopper.Kernel.Data;
using Grasshopper.Kernel.Types;
#endregion

public class Script_Instance : GH_ScriptInstance
{
    #region Notes
    /* 
      Members:
        RhinoDoc RhinoDocument
        GH_Document GrasshopperDocument
        IGH_Component Component
        int Iteration

      Methods (Virtual & overridable):
        Print(string text)
        Print(string format, params object[] args)
        Reflect(object obj)
        Reflect(object obj, string method_name)
    */
    #endregion

    private void RunScript(object x, object y, ref object a)
    {
        // Write your logic here
        a = null;
    }
}
# ---------- end c_script_4 ----------
ma = MassAddition(Input=int)  # -> Result, PartialResults
and = GateAnd()
shift = ShiftList(List=subset_2.List, Shift=Slider(1, range=0..1), Wrap=True)
division_3 = Division(A=subset.List, B=Slider(1000, range=0..1000))
subtraction = Subtraction(A=ma.Result, B=1)
concat = Concatenate(FragmentA=panel_6, FragmentB=subtraction, FragmentC=".json")
panel_7 = Panel("wxyz -> xyzw")
simplify_2 = SimplifyTree(Tree=shift, Front=False)
simplify_3 = SimplifyTree(Tree=division_3, Front=False)
item_9 = ListItem(List=flatten_3, Index=subtraction, Wrap=True)
crv_2 = Curve(item_9)
explode_2 = Explode(Curve=crv_2, Recursive=True)  # -> Segments, Vertices
graft_3 = GraftTree(Tree=explode_2.Segments, IncludeEmptyLists=True, IncludeNullItems=True)
divlength_2 = DivideLength(Curve=graft_3, Length=Slider(5000, range=0..10000))  # -> Points, Tangents, Parameters
lng_4 = ListLength(List=divlength_2.Tangents)
divide_2 = DivideCurve(Curve=graft_3, Count=lng_4, Kinks=False)  # -> Points, Tangents, Parameters
flatten_4 = FlattenTree(Tree=divide_2.Points, Path="{0}")
panel_8 = Panel(concat)
duppt = RemoveDuplicatePts(Points=flatten_4, Tolerance=0.01)
pline_4 = PolyLine(Vertices=duppt, Closed=False)
divide_3 = DivideCurve(Curve=pline_4, Count=Slider(48, range=0..10000), Kinks=False)  # -> Points, Tangents, Parameters
Y_2 = UnitY(Factor=1)
merge = Merge(Data1=simplify_3, Data2=simplify_2)
panel_9 = Panel(merge)
panel_10 = Panel(item_9)
c_script_5 = CSharpScript(x=divide_3.Points, y=Slider(3863, range=0..10000))  # -> out, a; inputs x: list of Plane
# ---------- c_script_5: C# ----------
// Grasshopper Script Instance
#region Usings
using System;
using System.Linq;
using System.Collections;
using System.Collections.Generic;
using System.Drawing;

using Rhino;
using Rhino.Geometry;

using Grasshopper;
using Grasshopper.Kernel;
using Grasshopper.Kernel.Data;
using Grasshopper.Kernel.Types;
#endregion

public class Script_Instance : GH_ScriptInstance
{
    #region Notes
    /* 
      Members:
        RhinoDoc RhinoDocument
        GH_Document GrasshopperDocument
        IGH_Component Component
        int Iteration

      Methods (Virtual & overridable):
        Print(string text)
        Print(string format, params object[] args)
        Reflect(object obj)
        Reflect(object obj, string method_name)
    */
    #endregion

    private void RunScript(List<Plane> x, object y, ref object a)
    {
        // Write your logic here
        Random r = new Random();

        List<Plane> newPlanes = new();
        newPlanes.AddRange(x);

        List<Plane> finalPlanes = new();

        while (newPlanes.Count > 0){
            if (newPlanes.Count == 1){
                finalPlanes.Add(newPlanes[0]);
                break;
            }
            int index = (int) r.NextInt64((long) 0,(long) newPlanes.Count);
            finalPlanes.Add(newPlanes[index]);
            newPlanes.RemoveAt(index);
        }
        a = finalPlanes;
    }
}
# ---------- end c_script_5 ----------
number_slider_8 = Slider(10, range=0..10)
panel_11 = Panel(ma.Result)
rev_2 = Reverse(Vector=Y_2)
Z_7 = UnitZ(Factor=1)
panel_12 = Panel(cctr_2.Pose)
pline_5 = PolyLine(Vertices=c_script_5.a, Closed=False)
join_2 = TextJoin(Text=merge, Join=",")
fillet = Fillet(Curve=pline_5, Radius=Slider(100, range=0..100))
divide_4 = DivideCurve(Curve=fillet, Count=Slider(3429, range=0..10000), Kinks=False)  # -> Points, Tangents, Parameters
pl_2 = ConstructPlane(Origin=divide_4.Points, XAxis=Z_7, YAxis=rev_2)
rotpl_3 = RotatePlane(plane=pl_2, X=0, Y=Slider(0, range=-180..180), Z=Slider(23, range=-180..180), flip=False, glb=False)
cctr_4 = CoordinateConvertor(Pose=[0, 0, 0, 1, 0, 0, 0], Plane=rotpl_3)  # -> Plane, Pose

# ---- group: scal
subset_3 = SubList(List=cctr_4.Pose, Domain="0 to 2", Wrap=True)  # -> List, Index
subset_4 = SubList(List=cctr_4.Pose, Domain="3 to 6", Wrap=True)  # -> List, Index
shift_2 = ShiftList(List=subset_4.List, Shift=Slider(1, range=0..1), Wrap=True)
division_4 = Division(A=subset_3.List, B=Slider(1000, range=0..1000))
simplify_4 = SimplifyTree(Tree=shift_2, Front=False)
simplify_5 = SimplifyTree(Tree=division_4, Front=False)
merge_2 = Merge(Data1=simplify_5, Data2=simplify_4)

# ----
join_3 = TextJoin(Text=merge_2, Join=",")
flatten_5 = FlattenTree(Tree=join_3, Path="{0}")
concat_2 = Concatenate(FragmentA="[", FragmentB=flatten_5, FragmentC="],")
c_script_6 = CSharpScript(x=flatten_5, y=Toggle(True))  # -> out, a, b, c, d, e, f, g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; inputs x: list of String, y: Boolean
# ---------- c_script_6: C# ----------
// Grasshopper Script Instance
#region Usings
using System;
using System.Linq;
using System.Collections.Generic;
using System.Net.Http;
using System.Text;
using System.Text.Json;
using System.Threading.Tasks;

using Rhino;

using Grasshopper;
using Grasshopper.Kernel;
using Grasshopper.Kernel.Data;
#endregion

public class Script_Instance : GH_ScriptInstance
{
    #region Notes
    /* 
      Members:
        RhinoDoc RhinoDocument
        GH_Document GrasshopperDocument
        IGH_Component Component
        int Iteration

      Methods (Virtual & overridable):
        Print(string text)
        Print(string format, params object[] args)
        Reflect(object obj)
        Reflect(object obj, string method_name)
    */
    #endregion

    private static readonly object _sync = new object();
    private static Task<PlanResponseData>? _runTask;
    private static bool _prevRun;

    private void RunScript(
		List<string> x,
		bool y,
		ref object a,
		ref object b,
		ref object c,
		ref object d,
		ref object e,
		ref object f,
		ref object g,
		ref object h,
		ref object i,
		ref object j,
		ref object k)
    {
        if (!y)
        {
            lock (_sync)
            {
                _prevRun = false;
            }
            a = "Idle (set run=true to start)"; // status
            b = null; // http_status
            c = null; // request_id
            d = null; // plan_id
            e = null; // plan_success
            f = null; // error_code
            g = null; // message
            h = null; // fraction
            i = null; // failed_target_index
            j = null; // axes_path
            k = null; // full_response_json
            return;
        }

        try
        {
            var poses = x
                .Where(s => !string.IsNullOrWhiteSpace(s))
                .Select(s => s.Split(',')
                    .Select(v => Convert.ToDouble(v.Trim(), System.Globalization.CultureInfo.InvariantCulture))
                    .ToArray())
                .ToList();

            Task<PlanResponseData>? taskSnapshot;
            bool shouldStart;
            lock (_sync)
            {
                shouldStart = !_prevRun && _runTask is null;
                if (shouldStart)
                {
                    _runTask = Task.Run(() => MoveItCartesianClient.PlanMultiTargetAsync(poses));
                    _runTask.ContinueWith(_ =>
                    {
                        RhinoApp.InvokeOnUiThread((Action)(() => Component.ExpireSolution(true)));
                    });
                    _prevRun = true;
                }
                taskSnapshot = _runTask;
            }

            if (taskSnapshot is null)
            {
                a = "Done. Toggle run=false then run=true to start again.";
                b = null;
                c = null;
                d = null;
                e = null;
                f = null;
                g = null;
                h = null;
                i = null;
                j = null;
                k = null;
                return;
            }

            if (!taskSnapshot.IsCompleted)
            {
                a = "Planning multi-target path in background...";
                b = null;
                c = null;
                d = null;
                e = null;
                f = null;
                g = null;
                h = null;
                i = null;
                j = null;
                k = null;
                return;
            }

            if (taskSnapshot.IsFaulted)
            {
                string message = taskSnapshot.Exception?.GetBaseException().Message ?? "Unknown error";
                a = "Error: " + message;
                b = null;
                c = null;
                d = null;
                e = null;
                f = null;
                g = null;
                h = null;
                i = null;
                j = null;
                k = null;
                lock (_sync)
                {
                    _runTask = null;
                }
                return;
            }

            if (taskSnapshot.IsCanceled)
            {
                a = "Cancelled";
                b = null;
                c = null;
                d = null;
                e = null;
                f = null;
                g = null;
                h = null;
                i = null;
                j = null;
                k = null;
                lock (_sync)
                {
                    _runTask = null;
                }
                return;
            }

            PlanResponseData result = taskSnapshot.Result;
            a = "Done";
            b = result.Status;
            c = $"request_id: {result.GetString("request_id")}";
            d = $"plan_id: {result.GetString("plan_id")}";
            e = $"plan_success: {result.GetBool("plan_success")}";
            f = $"error/success_code: {result.GetAny("error_code")}";
            g = $"message: {result.GetString("message")}";
            h = $"fraction: {result.GetDouble("fraction")}";
            i = $"Progres: {result.GetInt("failed_target_index")}";
            j = result.GetAxesPathTree();
            k = result.PrettyJson;

            lock (_sync)
            {
                _runTask = null;
            }
        }
        catch (Exception ex)
        {
            a = "Error: " + ex.Message;
            b = null;
            c = null;
            d = null;
            e = null;
            f = null;
            g = null;
            h = null;
            i = null;
            j = null;
            k = null;
        }
    }
}

public static class MoveItCartesianClient
{
    private static readonly double[] DefaultQuat =
    {
        0.7071067811865476,
        3.14018491736755e-16,
        0.7071067811865475,
        -4.710277376051352e-16,
    };

    private const string ServerBaseUrl = "http://172.21.1.108:8000";

    public static async Task<PlanResponseData> PlanMultiTargetAsync(List<double[]> poses)
    {
        if (poses is null || poses.Count < 2)
        {
            throw new ArgumentException("Provide at least 2 poses.", nameof(poses));
        }

        List<double[]> targets = BuildTargets(poses);

        using var httpClient = new HttpClient { Timeout = TimeSpan.FromSeconds(120) };

        var planBody = new
        {
            frame_id = "world",
            link_name = "spray_cone.stp",
            targets,
            max_step = 0.005,
            jump_threshold = 0.0,
            avoid_collisions = true,
        };

        var (planStatus, planJson) = await RequestJsonAsync(
            httpClient,
            HttpMethod.Post,
            "/plan_cartesian_targets",
            planBody
        );

        return new PlanResponseData(planStatus, planJson);
    }

    private static List<double[]> BuildTargets(List<double[]> poses)
    {
        var targets = new List<double[]>(poses.Count);
        foreach (double[] pose in poses)
        {
            if (pose.Length == 7)
            {
                targets.Add((double[])pose.Clone());
                continue;
            }

            if (pose.Length == 3)
            {
                targets.Add(new[]
                {
                    pose[0],
                    pose[1],
                    pose[2],
                    DefaultQuat[0],
                    DefaultQuat[1],
                    DefaultQuat[2],
                    DefaultQuat[3],
                });
                continue;
            }

            throw new ArgumentException(
                $"Each pose must be length 3 or 7. Got length={pose.Length}",
                nameof(poses)
            );
        }

        return targets;
    }

    private static async Task<(int status, JsonElement json)> RequestJsonAsync(
        HttpClient client,
        HttpMethod method,
        string path,
        object body
    )
    {
        using var request = new HttpRequestMessage(method, $"{ServerBaseUrl}{path}");

        if (body is not null)
        {
            string payload = JsonSerializer.Serialize(body);
            request.Content = new StringContent(payload, Encoding.UTF8, "application/json");
        }

        using HttpResponseMessage response = await client.SendAsync(request);
        string responseBody = await response.Content.ReadAsStringAsync();

        using JsonDocument document = string.IsNullOrWhiteSpace(responseBody)
            ? JsonDocument.Parse("{}")
            : JsonDocument.Parse(responseBody);

        return ((int)response.StatusCode, document.RootElement.Clone());
    }

}

public record PlanResponseData(int Status, JsonElement Json)
{
    public string PrettyJson => JsonSerializer.Serialize(Json, new JsonSerializerOptions { WriteIndented = true });

    public object? GetAny(string property)
    {
        if (!Json.TryGetProperty(property, out JsonElement value))
        {
            return null;
        }

        return value.ValueKind switch
        {
            JsonValueKind.String => value.GetString(),
            JsonValueKind.Number => value.ToString(),
            JsonValueKind.True => true,
            JsonValueKind.False => false,
            JsonValueKind.Null => null,
            _ => value.ToString(),
        };
    }

    public string? GetString(string property)
    {
        if (!Json.TryGetProperty(property, out JsonElement value))
        {
            return null;
        }
        return value.ValueKind == JsonValueKind.String ? value.GetString() : value.ToString();
    }

    public bool? GetBool(string property)
    {
        if (!Json.TryGetProperty(property, out JsonElement value))
        {
            return null;
        }
        return value.ValueKind == JsonValueKind.True
            ? true
            : value.ValueKind == JsonValueKind.False ? false : null;
    }

    public double? GetDouble(string property)
    {
        if (!Json.TryGetProperty(property, out JsonElement value))
        {
            return null;
        }
        return value.ValueKind == JsonValueKind.Number && value.TryGetDouble(out double v) ? v : null;
    }

    public int? GetInt(string property)
    {
        if (!Json.TryGetProperty(property, out JsonElement value))
        {
            return null;
        }
        return value.ValueKind == JsonValueKind.Number && value.TryGetInt32(out int v) ? v : null;
    }

    public string? GetPrettyJson(string property)
    {
        if (!Json.TryGetProperty(property, out JsonElement value))
        {
            return null;
        }
        return JsonSerializer.Serialize(value, new JsonSerializerOptions { WriteIndented = true });
    }

    public DataTree<double>? GetAxesPathTree()
    {
        if (!Json.TryGetProperty("axes_path", out JsonElement axesPath))
        {
            return null;
        }

        if (!axesPath.TryGetProperty("points", out JsonElement points)
            || points.ValueKind != JsonValueKind.Array)
        {
            return null;
        }

        var tree = new DataTree<double>();
        int i = 0;
        foreach (JsonElement point in points.EnumerateArray())
        {
            if (!point.TryGetProperty("positions", out JsonElement positions)
                || positions.ValueKind != JsonValueKind.Array)
            {
                i++;
                continue;
            }

            var path = new GH_Path(i);
            foreach (JsonElement pos in positions.EnumerateArray())
            {
                if (pos.ValueKind == JsonValueKind.Number && pos.TryGetDouble(out double value))
                {
                    tree.Add(value, path);
                }
            }
            i++;
        }

        return tree;
    }
}
# ---------- end c_script_6 ----------
writetofile = WriteToFile(Write=button_2, TxtContent=c_script_6.k, FilePath=concat)
item_10 = ListItem(List=c_script_6.j, Index=0, Wrap=True)
merge_3 = Merge(
    Data1=c_script_6.a,
    Data2=c_script_6.b,
    Data3=c_script_6.c,
    Data4=c_script_6.d,
    Data5=c_script_6.e,
    Data6=c_script_6.f,
    Data7=c_script_6.g,
    Data8=c_script_6.h,
    Data9=c_script_6.i)
panel_14 = Panel(merge_3)
flatten_6 = FlattenTree(Tree=item_10, Path="{0}")
item_11 = ListItem(List=concat_2, Index=0, Wrap=True)
lng_5 = ListLength(List=flatten_6)  # -> expr("x - 1", Length)
multiplication_2 = Multiplication(A=lng_5, B=c_script_6.h, C=Slider(0.76, range=0..1))
branch = TreeBranch(Tree=c_script_6.j, Path=multiplication_2, MaintainPaths=True)
item_12 = ListItem(List=branch, Index=0, Wrap=True)  # -> Item, Item1, Item2, Item3, Item4, Item5
geo_3 = Geometry(<brep referenced from the Rhino model>)
geo_4 = Geometry(<brep referenced from the Rhino model>)
geo_5 = Geometry(<brep referenced from the Rhino model>)
geo_6 = Geometry(<brep referenced from the Rhino model>)
geo_7 = Geometry(<brep referenced from the Rhino model>)
geo_8 = Geometry(<brep referenced from the Rhino model>)
mesh = Mesh(geo_3)
mesh_2 = Mesh(geo_4)
mesh_3 = Mesh(geo_7)
mesh_4 = Mesh(geo_5)
mesh_5 = Mesh(geo_6)
mesh_6 = Mesh(geo_8)
pt_3 = Point(Point(4890.389786, 194.0783266, 1862.047588))
pt_4 = Point(Point(1836.936734, 0, 2063.730363))
pt_5 = Point(Point(3426.802785, 1.287663742e-05, 2382.839005))
pt_6 = Point(Point(4958.43792, 199.7517162, 1719.452595))
Z_8 = UnitZ(Factor=item_12.Item3)
xy_3 = XYPlane(Origin=Point(0, 0, 0))
xy_4 = XYPlane(Origin=pt_4)
xy_5 = XYPlane(Origin=pt_5)
xz = XZPlane(Origin=pt_3)
yz = YZPlane(Origin=pt_6)
multiplication_3 = Multiplication(A=Z_8, B=Slider(1000, range=0..1000), C="-1")
neg_4 = Negative(Value=item_12.Item5)
rotate = Rotate(Angle=item_12.Item, Plane=xy_3)  # -> Geometry, Transform
rotate_2 = Rotate(Angle=item_12.Item1, Plane=xy_4)  # -> Geometry, Transform
rotate_3 = Rotate(Angle=item_12.Item2, Plane=xy_5)  # -> Geometry, Transform
move_3 = Move(Motion=multiplication_3)  # -> Geometry, Transform
rotate_4 = Rotate(Angle=item_12.Item4, Plane=xz)  # -> Geometry, Transform
rotate_5 = Rotate(Angle=neg_4, Plane=yz)  # -> Geometry, Transform
merge_4 = Merge(Data1=move_3.Transform, Data2=rotate_3.Transform, Data3=rotate_2.Transform, Data4=rotate.Transform)
merge_5 = Merge(
    Data1=rotate_4.Transform,
    Data2=move_3.Transform,
    Data3=rotate_3.Transform,
    Data4=rotate_2.Transform,
    Data5=rotate.Transform)
merge_6 = Merge(Data1=rotate_2.Transform, Data2=rotate.Transform)
merge_7 = Merge(
    Data1=rotate_5.Transform,
    Data2=rotate_4.Transform,
    Data3=move_3.Transform,
    Data4=rotate_3.Transform,
    Data5=rotate_2.Transform,
    Data6=rotate.Transform)
merge_8 = Merge(Data1=rotate_3.Transform, Data2=rotate_2.Transform, Data3=rotate.Transform)
comp = Compound(Transforms=merge_6)
comp_2 = Compound(Transforms=merge_8)
comp_3 = Compound(Transforms=merge_4)
comp_4 = Compound(Transforms=merge_5)
comp_5 = Compound(Transforms=merge_7)
transform = Transform(Geometry=mesh_5, Transform=rotate.Transform)
transform_2 = Transform(Geometry=mesh_6, Transform=comp)
transform_3 = Transform(Geometry=mesh_4, Transform=comp_2)
transform_4 = Transform(Geometry=mesh_3, Transform=comp_3)
transform_5 = Transform(Geometry=mesh, Transform=comp_5)
transform_6 = Transform(Geometry=mesh_2, Transform=comp_4)
merge_9 = Merge(Data1=transform, Data2=transform_2, Data3=transform_3, Data4=transform_4, Data5=transform_6, Data6=transform_5)
preview = CustomPreview(Geometry=merge_9, Material=ColourSwatch(SwatchColor=RGBA(98, 106, 255, 105)))
